# Grasshopper definition okapi_ver220404.gh (Grasshopper 1.0.7)
# plug-ins: Telepathy, Human UI, jSwan, Pufferfish

uiinportname = RemoteSender("Import")

editedltoolpath_nonspiral = RemoteReceiver()
cluster = Cluster_2(toolpath=editedltoolpath_nonspiral)  # -> xyz, layerpitch, F
curve_to_xyzf = CurveToXYZF(crv=editedltoolpath_nonspiral, relay_3=Toggle(False))  # -> s_0, D_2, D_3
panel = Panel("""fileName
startScript
endScript
filePath
retractionSpeed
filamentDiameter
nozzleDiameter
multipliar
retraction
firstLayerPitch
firstLayermulti
printSpeed
width
brimCount
brimBool""")
normal_layerpitch = RemoteSender(cluster.layerpitch)
normal_f = RemoteSender(curve_to_xyzf.D_2)
normal_xyz = RemoteSender(curve_to_xyzf.s_0)

panel_2 = Panel("""import
subdivide
rotate
bake""")
panel_3 = Panel("""3dモデル取り込み
サブディビジョン
回転
bake""")
panel_4 = Panel("言語")
lang = RemoteSender(Toggle(True))
lang_2 = RemoteReceiver(lang)
filter = StreamFilter(Gate=lang_2, Stream0=panel_2, Stream1=panel_3)
bang = ExplodeTree(Data=graft(filter))  # -> flatten(Branch0), flatten(Branch1), flatten(Branch2), flatten(Branch3)
subdivide = Slider(0, range=0..3)
txt = Text(bang.Branch0)
filepicker = CreateFilePicker(ButtonLabelText="・・・", DialogType=0, MustExist=True, Filter="All Files|*.*")
slider = CreateSlider(Slider=subdivide, ShowBounds=False, ShowTicks=False, ShowTooltip=False, ShowValLabel=True, showLabel=True)
toggle = CreateToggle(Default=False, OnLabel=bang.Branch2, OffLabel=bang.Branch2)
button = CreateButton(ButtonName=bang.Branch3, ButtonStyle=0)
merge = Merge(Data1=filepicker, Data2=slider, Data3=toggle, Data4=button)
values = ValueListener(Elements=merge, SomeProperty=True)  # -> Values, Indices
bang_2 = ExplodeTree(Data=values.Values)  # -> Branch0, Branch1, Branch2, Branch3
uiinport = RemoteSender(merge)
file = RemoteSender(bang_2.Branch0)
bake = RemoteSender(bang_2.Branch3)
rotate = RemoteSender(bang_2.Branch2)
subdivide_2 = RemoteSender(bang_2.Branch1)
panel_5 = Panel("""シンプル分割
すべての輪郭に基づいた分割
輪郭指定分割""")
panel_6 = Panel("""輪郭抽出
スライスモード選択
最大積層ピッチ(mm)
レイヤーピッチ範囲(mm)""")
panel_7 = Panel("ツールパス表示")
panel_8 = Panel("Spiralize")
panel_9 = Panel("""スライス方式
ベースモード""")
panel_10 = Panel("""Non-Planar
Planar""")
merge_2 = Merge(Data1="Simple Slice", Data2="Topological Slice", Data3="Partial Topological Slice")
lang_3 = RemoteReceiver(lang)
merge_3 = Merge(Data1="1. Extract Topology", Data2="2. Slice Mode", Data4="3. Max Layer Pitch (mm)", Data5="LayerPitch Domain (mm)")
filter_2 = StreamFilter(Gate=lang_3, Stream0=merge_2, Stream1=panel_5)
merge_4 = Merge(Data1="Mode", Data2="Spiralize")
merge_5 = Merge(Data1=Slider(0, range=0..100), Data2=Slider(1, range=0..1), Data3=Slider(2, range=0..10))
lang_4 = RemoteReceiver(lang)
filter_3 = StreamFilter(Gate=lang_3, Stream0=merge_4, Stream1=panel_9)
filter_4 = StreamFilter(Gate=lang_4, Stream0=merge_3, Stream1=panel_6)
merge_6 = Merge(Data1=Slider(2.2, range=0..10))
pulldown = CreatePulldownMenu(Label=" ", ListItems=filter_2, showLabel=True)
merge_7 = Merge(Data1="レイヤーピッチ(mm)", Data2="モデル選択")
checkbox = CreateCheckbox(Label="select", StartingValue=False)
textbox = CreateTextBox(Label=" ", DefaultText=merge_6, UpdateButton=True, showLabel=True)
tb = CreateTextBlock(Text="0 to 0", TextSize=12, Justification=0)
toggle_2 = CreateToggle(Default=False)
pulldown_2 = CreatePulldownMenu(ListItems=panel_10, showLabel=True)
toggle_3 = CreateToggle(Default=False, OnLabel=" ", OffLabel=" ")
label = CreateLabel(LabelText=filter_4, LabelSize=12, Justification=0)
toggle_4 = CreateToggle(Default=False, OnLabel=" ", OffLabel=" ")
label_2 = CreateLabel(LabelText=merge_7, LabelSize=12, Justification=0)
textbox_2 = CreateTextBox(DefaultText=Slider(2.2, range=0..10), UpdateButton=False, showLabel=True)
label_3 = CreateLabel(LabelText=filter_3, LabelSize=12, Justification=0)
uislicename = RemoteSender("Slice")
merge_8 = Merge(Data1=toggle_3, Data2=pulldown, Data3=textbox, Data4=tb)
merge_9 = Merge(Data1=textbox_2, Data2=toggle_2)
merge_10 = Merge(Data1=pulldown_2, Data2=toggle_4)
entwine = Entwine(Branch00=label_3, Branch01=merge_10, FlattenInputs=True)
bang_3 = ExplodeTree(Data=graft(merge_10))  # -> Branch0, Branch1
values_2 = ValueListener(Elements=bang_3.Branch0, SomeProperty=True)  # -> flatten(Values), Indices
bang_4 = ExplodeTree(Data=graft(merge_8))  # -> Branch0, Branch1, Branch2, Branch3, Branch4
values_3 = ValueListener(Elements=textbox, SomeProperty=True)  # -> Values, Indices
values_4 = ValueListener(Elements=merge_9, SomeProperty=True)  # -> Values, Indices
values_5 = ValueListener(Elements=bang_3.Branch1, SomeProperty=True)  # -> Values, Indices
uimodeselectcontents = RemoteSender(panel_10)
cluster_2 = Cluster_4(name=label_2, data=merge_9)
bang_5 = ExplodeTree(Data=values_4.Values)  # -> Branch0, Branch1
slicemode = RemoteSender(values_2.Indices)
values_6 = ValueListener(Elements=bang_4.Branch1, SomeProperty=True)  # -> Values, Indices
values_7 = ValueListener(Elements=bang_4.Branch0, SomeProperty=True)  # -> Values, Indices
spiralbool = RemoteSender(values_5.Values)
ui_planar = RemoteSender(cluster_2)
layercount = RemoteSender(values_3.Values)
keysearch = KeyValueSearch(Keys=filter_2, Values=merge_5, Search=values_6.Values)
layerpitch = RemoteSender(bang_5.Branch0)
geoselect = RemoteSender(bang_5.Branch1)
edge = RemoteSender(values_7.Values)
uislice = RemoteSender()
crease = RemoteSender(keysearch)
panel_11 = Panel("""シンプル分割
編みの間隔
編みの強さ""")
panel_12 = Panel("""テクスチャ無し
編み
ランダム""")
merge_11 = Merge(Data1="Plain", Data2="Knit", Data3="Random")
merge_12 = Merge(Data1="Simple Divide", Data2="Wave Length(mm)", Data3="Amplitude(mm)", Data4="Range")
lang_5 = RemoteReceiver(lang)
filter_5 = StreamFilter(Gate=lang_5, Stream0=merge_11, Stream1=panel_12)
filter_6 = StreamFilter(Gate=lang_5, Stream0=merge_12, Stream1=panel_11)
merge_13 = Merge(Data1=Slider(2.2, range=0..10))
merge_14 = Merge(Data1=Slider(2.2, range=0..10))
button_2 = CreateButton(ButtonName="Update", ButtonStyle=0)
uidividemode = RemoteSender()
textbox_3 = CreateTextBox(DefaultText=merge_13, UpdateButton=False, showLabel=True)
textbox_4 = CreateTextBox(DefaultText=merge_14, UpdateButton=False, showLabel=True)
merge_15 = Merge(Data1=Slider(6, range=0..10), Data2=Slider(2, range=0..10))
pulldown_3 = CreatePulldownMenu(ListItems=filter_5, showLabel=True)
toggle_5 = CreateToggle(Default=False)
label_4 = CreateLabel(LabelText=filter_6, LabelSize=12, Justification=0)
concat = Concatenate(FragmentA="2", FragmentB="*")
values_8 = ValueListener(Elements=pulldown_3, SomeProperty=True)  # -> Values, Indices
adjustpos = AdjustElementPositioning(ElementsToAdjust=pulldown_3, AbsolutePositioning=False, HorizontalAlignment=3, VerticalAlignment=1)
simplegrid = CreateSimpleGrid(UIElements=pulldown_3, RowDefinitions=concat, ColumnDefinitions="3*")
merge_16 = Merge(Data1=toggle_5, Data2=textbox_3, Data3=textbox_4, Data5=button_2)
bang_6 = ExplodeTree(Data=graft(merge_16))  # -> Branch0, Branch1, Branch2, Branch3, Branch4
settextbox = SetTextBoxContents(TextBoxToModify=[textbox_3, textbox_4], NewTextBoxContents=merge_15)
cluster_3 = Cluster_4(name=label_4, data=merge_16)
uidividemodename = RemoteSender("Texture Pattern")
uieditcurvemode = RemoteSender(simplegrid)
editcurvemode = RemoteSender(values_8.Indices)
uieditcurvename = RemoteSender("Point Edit")
values_9 = ValueListener(Elements=bang_6.Branch4, SomeProperty=True)  # -> Values, Indices
uiamisettingname = RemoteSender("Setting")
merge_17 = Merge(Data1=bang_6.Branch0, Data2=bang_6.Branch1, Data3=bang_6.Branch2, Data4=bang_6.Branch3)
uiamisetting = RemoteSender(cluster_3)
values_10 = ValueListener(Elements=merge_17, Trigger=values_9.Values, SomeProperty=False)  # -> Values, Indices
bang_7 = ExplodeTree(Data=graft(values_10.Values))  # -> Branch0, Branch1, Branch2, Branch3
textruedomain = RemoteSender(bang_7.Branch3)
amplitude = RemoteSender(bang_7.Branch2)
segmentlength = RemoteSender(bang_7.Branch1)
divideoption = RemoteSender(bang_7.Branch0)
merge_18 = Merge(Data1="リトラクション距離(mm)", Data2="リトラクションスピード(mm/s)")
merge_19 = Merge(Data1="Retraction Length(mm)", Data2="Retraction Speed(mm/min)")
merge_20 = Merge(Data1="Print Speed (mm/s)")
merge_21 = Merge(Data1="フィラメント径 (mm)", Data2="ノズル径 (mm)", Data3="吐出乗数")
merge_22 = Merge(Data1="Filament Diameter(mm)", Data2="Nozzle Diameter(mm)", Data3="Extrusion Multi")
merge_23 = Merge(Data1="Brim Count", Data2="Brim Width(mm)", Data3="Option")
merge_24 = Merge(Data1="ブリム数", Data2="ブリム幅", Data3="ブリム")
lang_6 = RemoteReceiver(lang)
lang_7 = RemoteReceiver(lang)
リトラクションスピード_mm_s = Slider(2000, range=0..10000)
merge_25 = Merge(Data1="1.45", Data2="1", Data3="1")
リトラクション距離_mm = Slider(0, range=0..10)
filter_7 = StreamFilter(Gate=lang_6, Stream0=merge_22, Stream1=merge_21)
panel_13 = Panel("ブリム数")
filter_8 = StreamFilter(Gate=lang_6, Stream0="Print Speed (mm/s)", Stream1="造形速度(mm/s)")
merge_26 = Merge(Data1="初期レイヤーピッチ(mm)", Data2="初期レイヤー吐出乗数")
merge_27 = Merge(Data1="FirstLayerPitch(mm)", Data2="FirstLayerMulti")
filter_9 = StreamFilter(Gate=lang_7, Stream0=merge_19, Stream1=merge_18)
panel_14 = Panel("リトラクション")
lang_8 = RemoteReceiver(lang)
label_5 = CreateLabel(LabelText=filter_7, LabelSize=12, Justification=0)
filter_10 = StreamFilter(Gate=lang_6, Stream0=merge_27, Stream1=merge_26)
merge_28 = Merge(Data1="2", Data2="4")
merge_29 = Merge(Data1=Slider(800, range=0..1000))
filter_11 = StreamFilter(Gate=lang_8, Stream0=merge_23, Stream1=merge_24)
textbox_5 = CreateTextBox(DefaultText=merge_25, UpdateButton=False, showLabel=True)
merge_30 = Merge(Data1=リトラクション距離_mm, Data2=リトラクションスピード_mm_s)
toggle_6 = CreateToggle(Default=False, OnLabel="内側", OffLabel="外側")
textbox_6 = CreateTextBox(DefaultText=merge_29, UpdateButton=False, showLabel=True)
label_6 = CreateLabel(LabelText=filter_8, LabelSize=12, Justification=0)
label_7 = CreateLabel(LabelText=filter_11, LabelSize=12, Justification=0)
textbox_7 = CreateTextBox(DefaultText=merge_28, UpdateButton=False, showLabel=True)
label_8 = CreateLabel(LabelText=filter_9, LabelSize=12, Justification=0)
textbox_8 = CreateTextBox(DefaultText=merge_30, UpdateButton=False, showLabel=True)
merge_31 = Merge(Data1=Slider(1, range=0..10), Data2=Slider(1, range=0..1))
toggle_7 = CreateToggle(Default=False, OnLabel="Inner", OffLabel="Outer")
uiretractionname = RemoteSender("Retraction")
merge_32 = Merge(Data1=textbox_7, Data2=toggle_7)
textbox_9 = CreateTextBox(DefaultText=merge_31, UpdateButton=False, showLabel=True)
label_9 = CreateLabel(LabelText=filter_10, LabelSize=12, Justification=0)
uisettingname = RemoteSender("Settings")
uibrimname = RemoteSender("Brim")
ui_firstlayerpitchname = RemoteSender("Layer Pitch")
uispeedname = RemoteSender("Print Speed")
uinozzlename = RemoteSender("Nozzle")
end = Panel("""G28 X0 ; home X axis
M106 S0 ; turn off cooling fan
M104 S0 ; turn off extruder
M140 S0 ; turn off bed
M84 ; disable motors""")
start = Panel("""G28 ; home all axes
G1 X5 Y10 Z0.2 F3000 ; get ready to prime
G92 E0 ; reset extrusion distance
G1 X160 E15 F600 ; prime nozzle
G1 X180 F5000 ; quick wipe""")
filepicker_2 = CreateFilePicker(ButtonLabelText="・・・", DialogType=0, MustExist=True, Filter="All Files|*.*")
number_slider = Slider(220, range=0..10000)
panel_15 = Panel("開始動作")
panel_16 = Panel("終了動作")
panel_17 = Panel("ender3")
button_3 = CreateButton(ButtonName="設定読み込み", ButtonStyle=0)
button_4 = CreateButton(ButtonName="設定更新", ButtonStyle=0)
merge_33 = Merge(Data1="設定読み込み", Data2="設定読み込み", Data3="設定読み込み")
entwine_2 = Entwine(Branch00=start, Branch01=end, FlattenInputs=True)
merge_34 = Merge(Data1=filepicker_2, Data3=button_4)
entwine_3 = Entwine(Branch00="ender3", FlattenInputs=True)  # -> flatten(Result)
textbox_10 = CreateTextBox(Label="Start Script", DefaultText="1", UpdateButton=False, showLabel=True)
textbox_11 = CreateTextBox(Label="End Script", DefaultText="1", UpdateButton=False, showLabel=True)
panel_18 = Panel("プロファイル")
pulldown_4 = CreatePulldownMenu(Label="Profile", ListItems=entwine_3, showLabel=True)
vec = VectorXYZ(XComponent=number_slider, YComponent=number_slider, ZComponent=Slider(250, range=0..1000))  # -> Vector, Length
cluster_4 = Cluster_4(data=merge_34)
values_11 = ValueListener(Elements=filepicker_2, SomeProperty=True)  # -> Values, Indices
bang_8 = ExplodeTree(Data=graft(merge_34))  # -> Branch0, Branch1, Branch2
values_12 = ValueListener(Elements=textbox_11, SomeProperty=True)  # -> Values, Indices
values_13 = ValueListener(Elements=pulldown_4, SomeProperty=True)  # -> flatten(Values), Indices
values_14 = ValueListener(Elements=textbox_10, SomeProperty=True)  # -> Values, Indices
ui_exportname = RemoteSender("Export")
uijsonname = RemoteSender("setting")
values_15 = ValueListener(Elements=bang_8.Branch1, SomeProperty=True)  # -> Values, Indices
merge_35 = Merge(Data1=pulldown_4, Data2=textbox_10, Data3=textbox_11)
uijson = RemoteSender(cluster_4)
dejson = DeserializeJson(JSON=values_11.Values, OutputsLocked=False)  # -> FileName, StartScript, EndScript, FilePath, RetractionSpeed, FilamentDiameter, NozzleDiameter, Multipliar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
filter_12 = StreamFilter(Gate=values_13.Indices, Stream0=entwine_2, Stream1=entwine_2)
filter_13 = StreamFilter(Gate=values_13.Indices, Stream0=vec.Vector, Stream1=vec.Vector)
uistartscriptname = RemoteSender("Scripts")
ui_endscript = RemoteSender(textbox_11)
startscript = RemoteSender(values_14.Values)
uicustomscript = RemoteSender(merge_35)
gcodepreview = RemoteSender(values_15.Values)
gcodepreview_2 = RemoteReceiver(gcodepreview)
gcodepreview_3 = RemoteReceiver(gcodepreview)
gcodepreview_4 = RemoteReceiver(gcodepreview)
gcodepreview_5 = RemoteReceiver(gcodepreview)
gcodepreview_6 = RemoteReceiver(gcodepreview)
gcodepreview_7 = RemoteReceiver(gcodepreview)
endscript = RemoteSender(values_12.Values)
bang_9 = ExplodeTree(Data=filter_12)  # -> Branch0, Branch1
settextbox_2 = SetTextBoxContents(TextBoxToModify=textbox_10, NewTextBoxContents=bang_9.Branch0)
settextbox_3 = SetTextBoxContents(TextBoxToModify=textbox_11, NewTextBoxContents=bang_9.Branch1)
pdecon = Deconstruct(Point=filter_13)  # -> XComponent, YComponent, ZComponent
jsonfilename = RemoteSender(dejson.FileName)
jsonstartscript = RemoteSender(dejson.StartScript)
jsonstartscript_2 = RemoteReceiver(jsonstartscript)
cluster_5 = Cluster_3(relay=jsonstartscript_2)
settextbox_4 = SetTextBoxContents(TextBoxToModify=textbox_10, NewTextBoxContents=jsonstartscript_2)
jsonendscript = RemoteSender(dejson.EndScript)
jsonendscript_2 = RemoteReceiver(jsonendscript)
jsonmultipliar = RemoteSender(dejson.Multipliar)
jsonmultipliar_2 = RemoteReceiver(jsonmultipliar)
jsonretraction = RemoteSender(dejson.Retraction)
jsonretraction_2 = RemoteReceiver(jsonretraction)
jsonfirstlayerpitch = RemoteSender(dejson.FirstLayerPitch)
jsonfirstlayerpitch_2 = RemoteReceiver(jsonfirstlayerpitch)
jsonfirstlayermulti = RemoteSender(dejson.FirstLayermulti)
jsonfirstlayermulti_2 = RemoteReceiver(jsonfirstlayermulti)
merge_36 = Merge(Data1=jsonfirstlayerpitch_2, Data2=jsonfirstlayermulti_2)
jsonprintspeed = RemoteSender(dejson.PrintSpeed)
jsonprintspeed_2 = RemoteReceiver(jsonprintspeed)
jsonretractionspeed = RemoteSender(dejson.RetractionSpeed)
jsonretractionspeed_2 = RemoteReceiver(jsonretractionspeed)
merge_37 = Merge(Data1=jsonretraction_2, Data2=jsonretractionspeed_2)
jsonfilamentdiameter = RemoteSender(dejson.FilamentDiameter)
jsonfilamentdiameter_2 = RemoteReceiver(jsonfilamentdiameter)
jsonnozzlediameter = RemoteSender(dejson.NozzleDiameter)
jsonnozzlediameter_2 = RemoteReceiver(jsonnozzlediameter)
merge_38 = Merge(Data1=jsonfilamentdiameter_2, Data2=jsonnozzlediameter_2, Data3=jsonmultipliar_2)
reset = RemoteSender(Toggle(False))
reset_2 = RemoteReceiver(reset)
reset_3 = RemoteReceiver(reset)
reset_4 = RemoteReceiver(reset)
reset_5 = RemoteReceiver(reset)
reset_6 = RemoteReceiver(reset)
panel_19 = Panel(reset_5)
jsonbrimcount = RemoteSender(dejson.BrimCount)
jsonbrimcount_2 = RemoteReceiver(jsonbrimcount)
jsonwidth = RemoteSender(dejson.Width)
jsonwidth_2 = RemoteReceiver(jsonwidth)
merge_39 = Merge(Data1=jsonbrimcount_2, Data2=jsonwidth_2)
jsonbrimbool = RemoteSender(dejson.BrimBool)
jsonbrimbool_2 = RemoteReceiver(jsonbrimbool)
uiselectprofilename = RemoteSender("Profile")
uiselectprofile = RemoteSender(merge_35)
dom = ConstructDomain(DomainStart=0, DomainEnd=pdecon.XComponent)
dom_2 = ConstructDomain(DomainStart=0, DomainEnd=pdecon.YComponent)
dom_3 = ConstructDomain(DomainStart=0, DomainEnd=pdecon.ZComponent)
panel_20 = Panel(reset)
box = DomainBox(Base=PlaneXY(0, 0, 0), X=dom, Y=dom_2, Z=dom_3)
settextbox_5 = SetTextBoxContents(TextBoxToModify=textbox_10, NewTextBoxContents=bang_9.Branch0)
settextbox_6 = SetTextBoxContents(TextBoxToModify=textbox_11, NewTextBoxContents=bang_9.Branch1)
wires = BrepWireframe(Brep=box, Density=-1)
planesrf = PlaneSurface(Plane=PlaneXY(0, 0, 0), XSize=dom, YSize=dom_2)
geo = Geometry(planesrf)
merge_40 = Merge(Data1="0", Data2="0")
lang_9 = RemoteReceiver(lang)
panel_21 = Panel("保存")
merge_41 = Merge(Data1="X", Data2="Y")
reset_7 = RemoteReceiver(reset)
ファイル名 = Panel("Project Name")
ファイル名_2 = Panel("プロジェクト名")
filter_14 = StreamFilter(Gate=lang_9, Stream0=ファイル名, Stream1=ファイル名_2)
textbox_12 = CreateTextBox(DefaultText=merge_40, UpdateButton=True, showLabel=True)
label_10 = CreateLabel(LabelText=merge_41, LabelSize=12, Justification=0)
jsonfilename_2 = RemoteReceiver(jsonfilename)
panel_22 = Panel("エクスポート")
ファイル書き出し = Button()
textbox_13 = CreateTextBox(Label=filter_14, DefaultText="new", UpdateButton=True, showLabel=True)
filepicker_3 = CreateFilePicker(ButtonLabelText="・・・", DialogType=2, MustExist=True, Filter="All Files|*.*")
button_5 = CreateButton(ButtonName=ファイル書き出し, ButtonStyle=0)
merge_42 = Merge(Data1=textbox_13, Data2=filepicker_3, Data3=button_5)
setbtn = SetButton(ButtonToModify=button_5, ButtonName="Save")
adjustelem = AdjustElementAppearance(ElementsToAdjust=textbox_13, FontSize=Slider(10, range=0..10))
values_16 = ValueListener(Elements=merge_42, SomeProperty=True)  # -> Values, Indices
bang_10 = ExplodeTree(Data=values_16.Values)  # -> Branch0, Branch1, Branch2
concat_2 = Concatenate(FragmentA=bang_10.Branch1, FragmentB="\")
uisavefilename = RemoteSender("Save")
rejsonkv = SerializeKeysAndValues(Key="FileName", Value=bang_10.Branch0)
uisavefile = RemoteSender(merge_42)
filename = RemoteSender(bang_10.Branch0)
filepath = RemoteSender(concat_2)
savefile = RemoteSender(bang_10.Branch2)
jsonelements = RemoteSender(rejsonkv)
uipositionname = RemoteSender("Position")
pan = Panel("""Impact
Arial
Segoe UI
Calibri
Verdana
Minion Pro
Rosewood Std
Tw Cen MT""")
uidividemodename_2 = RemoteSender()
uieditcurvename_2 = RemoteReceiver(uieditcurvename)
ui3dpreviewname = RemoteReceiver()
uidividemodename_3 = RemoteReceiver([uidividemodename, uidividemodename_2])
uiselectprofilename_2 = RemoteReceiver(uiselectprofilename)
ui_firstlayerpitchname_2 = RemoteReceiver(ui_firstlayerpitchname)
uipositionname_2 = RemoteReceiver(uipositionname)
uisavefilename_2 = RemoteReceiver(uisavefilename)
uiamisettingname_2 = RemoteReceiver(uiamisettingname)
uieditcurvemode_2 = RemoteReceiver(uieditcurvemode)
uistartscriptname_2 = RemoteReceiver(uistartscriptname)
uiretractionname_2 = RemoteReceiver(uiretractionname)
uiselectprofile_2 = RemoteReceiver(uiselectprofile)
uicustomscript_2 = RemoteReceiver(uicustomscript)
item = ListItem(List=pan, Index=Slider(1, range=0..10), Wrap=True)
uiamisetting_2 = RemoteReceiver(uiamisetting)
uiinportname_2 = RemoteReceiver(uiinportname)
uiselectname = RemoteReceiver()
uidividemode_2 = RemoteReceiver(uidividemode)
uisavefile_2 = RemoteReceiver(uisavefile)
uinozzlename_2 = RemoteReceiver(uinozzlename)
uispeedname_2 = RemoteReceiver(uispeedname)
uijsonname_2 = RemoteReceiver(uijsonname)
uijson_2 = RemoteReceiver(uijson)
uibrimname_2 = RemoteReceiver(uibrimname)
uiinport_2 = RemoteReceiver(uiinport)
okapi = Panel("ToolPath Designer 1.03")
okapi_2 = Panel(" ")
entwine_4 = Entwine(Branch00=uidividemodename_3, Branch01=uiamisettingname_2, FlattenInputs=True)
ui_exportname_2 = RemoteReceiver(ui_exportname)
entwine_5 = Entwine(Branch00=uieditcurvemode_2, Branch01=uiamisetting_2, FlattenInputs=True)
uieditcurvename_3 = RemoteReceiver(uieditcurvename)
entwine_6 = Entwine(Branch00=uipositionname_2, Branch01=uisavefilename_2, FlattenInputs=True)
uiinportname_3 = RemoteReceiver(uiinportname)
uislicename_2 = RemoteReceiver(uislicename)
uisettingname_2 = RemoteReceiver(uisettingname)
entwine_7 = Entwine(
    Branch00=uisavefilename_2,
    Branch01=uipositionname_2,
    Branch02=uijsonname_2,
    Branch03=uiselectprofilename_2,
    Branch04=ui_firstlayerpitchname_2,
    Branch05=uinozzlename_2,
    Branch06=uispeedname_2,
    Branch07=uibrimname_2,
    Branch08=uiretractionname_2,
    FlattenInputs=True)
colour = ColourPicker(PickedColour=RGB(255, 255, 255))
launchwin = LaunchWindow(
    Show=Toggle(True),
    Name=okapi_2,
    Width=Slider(454, range=0..1000),
    Height=Slider(958, range=0..10000),
    FontFamily=item,
    ChildStatus=0,
    EnableHorizScroll=False)
expander = CreateExpander(UIElements=entwine_5, Header=entwine_4, Open=True)  # -> flatten(Expander)
expander_2 = CreateExpander(UIElements=uiinport_2, Header=uiinportname_2, Open=True)  # -> flatten(Expander)
merge_43 = Merge(Data1=uiinportname_3, Data2=uislicename_2, Data3=uieditcurvename_3, Data4=ui_exportname_2)
entwine_8 = Entwine(Branch00=expander, FlattenInputs=True)
setexp = SetExpander(Expander=expander, ExpandedOpen=Toggle(True))
accent_colors = ValueList({"Amber", "Blue", "Brown", "Cobalt", "Crimson", "Cyan", "Emerald", "Green", "Indigo", "Lime", "Magenta", "Mauve", "Olive", "Orange", "Pink", "Purple", "Red", "Sienna", "Steel", "Taupe", "Teal", "Violet", "Yellow"}, selected="Orange")
setexp_2 = SetExpander(Expander=expander_2, ExpandedOpen=True)
winprops = SetWindowProperties(
    Window=launchwin,
    Theme=0,
    AccentColor=accent_colors,
    ShowTitleBar=True,
    BackgroundColor=colour,
    ScaleFactor=Slider(1, range=0..1))
path = FilePath("C:\Users\okapi\Creative Cloud Files\photo\pixture.png")
capture = CaptureWindowOrElementToFile(WindowOrElement=launchwin, FilePath=path, ScaleFactor=1, Run=Button(), CaptureEntireWindow=Toggle(False))

geoselect_2 = RemoteReceiver(geoselect)
python = GhPythonScript(select=geoselect_2)  # -> geo; inputs select: Boolean
# ---------- python: Python ----------
__author__ = "okapi"
__version__ = "2022.05.30"

import rhinoscriptsyntax as rs
import scriptcontext as sc
import Rhino

def getGeo(bool):
    if bool:
        sc.doc = Rhino.RhinoDoc.ActiveDoc
        geo_guid = rs.GetObject("meshを選択してください")
        geometry = rs.coercegeometry(geo_guid,True)
        return geometry

geo = getGeo(select)
sc.doc = ghdoc
# ---------- end python ----------
subdivide_3 = RemoteReceiver(subdivide_2)
rotate_2 = RemoteReceiver(rotate)
# 【fusionで作成したobjをインポートする】
# 
# １：
# ファイル参照を右クリック
# ↓
# select one existing file
# ↓
# インポートしたいobjファイルを選択
# 
# ２：
# メッシュ細分化レベルでなめらかさを調節
# 
# ３：
# bakeをクリック
bake_2 = RemoteReceiver(bake)
file_2 = RemoteReceiver(file)
cluster_6 = Cluster_7(relay=python)  # -> G, V
cluster_7 = Cluster_12(bake=bake_2, file=file_2, subdivide=subdivide_3, rotate=rotate_2)
geo_2 = RemoteSender(cluster_6.G)
crease_2 = RemoteReceiver(crease)
edge_2 = RemoteReceiver(edge)
panel_23 = Panel(edge_2)
gate = StreamGate(Stream="True", Gate=crease_2)  # -> Target0, Target1, Target2
python_2 = GhPythonScript(bool=edge_2)  # -> toolPath; inputs bool: Boolean
# ---------- python_2: Python ----------
__author__ = "okapi"
__version__ = "2022.02.24"
        
import rhinoscriptsyntax as rs
import Rhino.Geometry.Collections.MeshTopologyEdgeList as mte
import Rhino.Geometry.Collections.MeshTopologyVertexList as mtv
import Rhino.Geometry.Collections.MeshFaceList as mf
import Rhino.Geometry.Collections.MeshVertexList as mv
import scriptcontext as sc
import Rhino
import itertools
import GhPython 
import ghpythonlib.components as ghcomp

def get_weft_edge(mesh,originEdge,originPt):
            
    originEdgeEndPt = originPt
    linkedFaces = mte.GetConnectedFaces(mesh.TopologyEdges,originEdge)
    linkedVertices = mtv.ConnectedTopologyVertices(mesh.TopologyVertices,originEdgeEndPt)
        
    #extractLinkedFacesVertices
    list_linkedFacesVertices = []
    for i in linkedFaces:
        linkedFacesVertices = mf.GetTopologicalVertices(mesh.Faces,i)
        for j in linkedFacesVertices:
            list_linkedFacesVertices.append(j)
        
    #extractlinkedVertices
    list_linkedVertices = []
    for i in linkedVertices:
        list_linkedVertices.append(i)
        
    #findNextVertex
    linkedVertices  = set(list_linkedVertices).difference(set(list_linkedFacesVertices))
    #print list_linkedVertices, list_linkedFacesVertices, linkedVertices
    linkedVertices = list(linkedVertices)[0]
        
    nextEdge = mte.GetEdgeIndex(mesh.TopologyEdges,linkedVertices,originEdgeEndPt)
    nextEdgeVertices = mte.GetTopologyVertices(mesh.TopologyEdges,nextEdge)
    nextEdgeEndPt = list(set(nextEdgeVertices).difference(set([originPt])))[0]
            
    return nextEdge, nextEdgeEndPt
        
def get_weft_edge_loop(mesh,firstEdge,firstEdgeStartPt):
    edges = []
    pts = []
    loopCount = 0
    while loopCount < 5000:
        if loopCount == 0:
            secondEdge = get_weft_edge(mesh,firstEdge,firstEdgeStartPt)
            edges.append(secondEdge[0])
            pts.append(secondEdge[1])
        elif edges[loopCount -1] != firstEdge :
            nextEdge = get_weft_edge(mesh,edges[loopCount-1],pts[loopCount-1])
            edges.append(nextEdge[0])
            pts.append(nextEdge[1])
        else:
            #edges.append(firstEdge)
            #pts.append(firstEdgeStartPt)
            break
        loopCount += 1
#    edges.append(firstEdge)
#    pts.append(firstEdgeStartPt)
    return edges,pts
        
def get_opposite_edge(mesh,face,edge,pt): 
    #Extract face,edges and endPoint located on opposite sides in a face
            
    #extract opposite_edge
        #extract all edges in a face
    allEdges = mte.GetEdgesForFace(mesh.TopologyEdges,face) 
        #extract edges that are not on the opposite shore
    edge_endPoints = mte.GetTopologyVertices(mesh.TopologyEdges,edge)
    edge_endPoints_linkedEdges = []
    for i in edge_endPoints:
        edge_endPoints_linkedEdges.append(mtv.ConnectedEdges(mesh.TopologyVertices,i))
    edge_endPoints_linkedEdges = list(itertools.chain.from_iterable(edge_endPoints_linkedEdges))
    not_opposite_edge = list(set(allEdges).intersection(set(edge_endPoints_linkedEdges)))
        #extract opposite_edge
    opposite_edge = list(set(allEdges).difference(set(not_opposite_edge)))[0]
            
    #extract opposite_face
    opposite_edge_linkedFaces = mte.GetConnectedFaces(mesh.TopologyEdges,opposite_edge)
    if len(opposite_edge_linkedFaces) == 1:
        opposite_face = -1
        
    else:
        opposite_face = list(set(opposite_edge_linkedFaces).difference(set([face])))[0]
    #extract opposite_pt
    pt_connectedPoints = mtv.ConnectedTopologyVertices(mesh.TopologyVertices,pt)
    face_verticesPoints = mtv.IndicesFromFace(mesh.TopologyVertices,face)
    candidate_pt = list(set(pt_connectedPoints).intersection(set(face_verticesPoints)))
    opposite_pt = list(set(candidate_pt).difference(set(edge_endPoints)))[0]
    return opposite_face, opposite_edge, opposite_pt
            
    line = mte.EdgeLine(mesh.TopologyEdges,opposite_edge)
    line_guid = sc.doc.Objects.AddLine(line)
        
def get_opposite_edge_loop(mesh,firstFace,firstEdge,firstPt):
    num = 1
    face = [firstFace]
    edge = [firstEdge]
    pt = [firstPt]
    while num <50000:
        next = get_opposite_edge(mesh,face[num-1],edge[num-1],pt[num-1])
        face.append(next[0])
        edge.append(next[1])
        pt.append(next[2])
        if face[num] == -1:
            break
        num += 1
    return edge, pt
            
def get_end_faces(mesh):
    #extract end Faces Indices
    endFaces = []
    len_faces = len(mesh.Faces)
    bool = mf.GetConnectedFaces(mesh.Faces,0)
    return endFaces
        
def select_startPt(bool):
    if bool == True:
        bool = 0
        predoc = sc.doc
        sc.doc = Rhino.RhinoDoc.ActiveDoc
        mesh_guid = rs.GetObject("meshを選択してください")
        if mesh_guid == None:
            rs.MessageBox("やり直してください")
        face = rs.GetMeshFaces(mesh_guid,"始点と二番目の点を含む面を選択してください",1,1)[0]
        vertex0_guid = rs.GetMeshVertices(mesh_guid,"始点を選択してください",1,1)
        vertex1_guid = rs.GetMeshVertices(mesh_guid,"二番目の点を選択してください",1,1)
        mesh = rs.coercemesh(mesh_guid,True)
        vertex = vertex1_guid[0]
        sc.doc = ghdoc
        edge = mte.GetEdgeIndex(mesh.TopologyEdges,vertex0_guid[0],vertex1_guid[0])
        return mesh,face,edge,vertex
        
loopCount = 0
layerCount = 0
layerEdges = []  
        
    
startPt = select_startPt(bool)
mesh = startPt[0]
face = startPt[1]
edge = startPt[2]
vertex = startPt[3]
        
        
b = mte.EdgeLine(mesh.TopologyEdges,edge)
oe = get_opposite_edge_loop(mesh,face,edge,vertex)
        

toolPath = []
for i in range(len(oe[0])):
    a = []
    weftPoints = []
    weft = get_weft_edge_loop(mesh,oe[0][i],oe[1][i])
    for j in weft[0]:
        line = mte.EdgeLine(mesh.TopologyEdges,j)
        line_guid = sc.doc.Objects.AddLine(line)
        a.append(line_guid)
        
    for k in weft[1]:
        pointIndex = mtv.MeshVertexIndices(mesh.TopologyVertices,k)
        point = mv.Point3dAt(mesh.Vertices,pointIndex[0])
        weftPoints.append(point)
        

    weftPoints = ghcomp.ShiftList(weftPoints,-2,True)
    weftPoints.append(weftPoints[0])
    polyline_guid = rs.AddPolyline(weftPoints)
    toolPath.append(polyline_guid)
# ---------- end python_2 ----------
python_3 = GhPythonScript(bool=gate.Target2)  # -> curve
# ---------- python_3: Python ----------
import Rhino
import scriptcontext as sc
import rhinoscriptsyntax as rs

if bool:
    sc.doc = Rhino.RhinoDoc.ActiveDoc
    crv = Rhino.DocObjects.ObjectType.Curve
    rc, objref = Rhino.Input.RhinoGet.GetMultipleObjects("折り目を入れたいエッジループを選択してください",True,crv)
    if objref:
        curve = []
        for i in objref:
           curve.append(i.Curve())
        sc.doc = ghdoc
        curve = rs.JoinCurves(curve)
    else:
        curve = None
        sc.doc = ghdoc
# ---------- end python_3 ----------
geo_3 = RemoteReceiver(geo_2)
move = Move(Geometry=python_2, Motion=Vector(0, 0, 10))  # -> Geometry, Transform
layerpitch_2 = RemoteReceiver(layerpitch)
cluster_8 = Cluster_7(relay=move.Geometry)  # -> G, V
move_2 = Move(Geometry=python_3, Motion=Vector(0, 0, 10))  # -> Geometry, Transform
geo_4 = Geometry(cluster_8.G)
nporigintoolpath = RemoteSender(cluster_8.G)
cull_i = CullIndex(List=geo_4, Indices=[-1, 0], Wrap=True)
cluster_9 = Cluster_10(relay=move_2.Geometry, T=cluster_8.V)  # -> G, V
filter_15 = StreamFilter(Gate=crease_2, Stream0=cluster_9.G, Stream1=cull_i, Stream2=cluster_9.G)
edge_3 = RemoteReceiver(edge)
nporigintoolpath_2 = RemoteReceiver(nporigintoolpath)
nporigintoolpath_3 = RemoteReceiver(nporigintoolpath)
layercount_2 = RemoteReceiver(layercount)
gate_2 = StreamGate(Stream=nporigintoolpath_2, Gate=edge_3)  # -> Target0, Target1
qmeshtoolpath_edge = QmeshToolpath_Edge(crv=gate_2.Target1, relay=layercount_2, relay_2=filter_15)  # -> toolpath, I
qmeshtoolpath = QmeshToolpath(crv=gate_2.Target0, relay=layercount_2)  # -> toolpath, I

entwine_9 = Entwine(Branch00=label, Branch01=merge_8, FlattenInputs=True)
concat_3 = Concatenate(FragmentA="2", FragmentB="*")
simplegrid_2 = CreateSimpleGrid(UIElements=entwine_9, RowDefinitions=concat_3, ColumnDefinitions="3*")
adjustpos_2 = AdjustElementPositioning(ElementsToAdjust=entwine_9, AbsolutePositioning=False, HorizontalAlignment=3, VerticalAlignment=1)

concat_4 = Concatenate(FragmentA="2", FragmentB="*")
simplegrid_3 = CreateSimpleGrid(UIElements=entwine, RowDefinitions=concat_4, ColumnDefinitions="3*")
adjustpos_3 = AdjustElementPositioning(ElementsToAdjust=entwine, AbsolutePositioning=False, HorizontalAlignment=3, VerticalAlignment=1)

filter_16 = StreamFilter(Gate=edge_3, Stream0=qmeshtoolpath.toolpath, Stream1=qmeshtoolpath_edge.toolpath)
layerpitchdomain = RemoteSender([qmeshtoolpath_edge.I, qmeshtoolpath.I])
nptoolpath = RemoteSender(filter_16)
slicemode_2 = RemoteReceiver(slicemode)
nptoolpath_2 = RemoteReceiver(nptoolpath)
segmentlength_2 = RemoteReceiver(segmentlength)
divideoption_2 = RemoteReceiver(divideoption)
layerpitch_3 = RemoteReceiver(layerpitch)
slicemode_3 = RemoteReceiver(slicemode)
spiralbool_2 = RemoteReceiver(spiralbool)
editcurvemode_2 = RemoteReceiver(editcurvemode)
amplitude_2 = RemoteReceiver(amplitude)
textruedomain_2 = RemoteReceiver(textruedomain)
startscript_2 = RemoteReceiver(startscript)
endscript_2 = RemoteReceiver(endscript)
filename_2 = RemoteReceiver(filename)
savefile_2 = RemoteReceiver(savefile)
filepath_2 = RemoteReceiver(filepath)
jsonelements_2 = RemoteReceiver(graft(jsonelements))
startscript_3 = RemoteReceiver(startscript)
endscript_3 = RemoteReceiver(endscript)
filename_3 = RemoteReceiver(filename)
filepath_3 = RemoteReceiver(filepath)
dejson_2 = DeserializeJson(JSON=jsonelements_2, OutputsLocked=False)

gate_3 = StreamGate(Stream=textbox_5, Gate=reset_2)  # -> Target0, Target1
settextbox_7 = SetTextBoxContents(TextBoxToModify=gate_3.Target0, NewTextBoxContents=merge_38)

gate_4 = StreamGate(Stream=textbox_8, Gate=reset_3)  # -> Target0, Target1
settextbox_8 = SetTextBoxContents(TextBoxToModify=gate_4.Target0, NewTextBoxContents=merge_37)

gate_5 = StreamGate(Stream=textbox_6, Gate=reset_4)  # -> Target0, Target1
settextbox_9 = SetTextBoxContents(TextBoxToModify=gate_5.Target0, NewTextBoxContents=jsonprintspeed_2)

entwine_10 = Entwine(Branch00=label_5, Branch01=textbox_5, FlattenInputs=True)
concat_5 = Concatenate(FragmentA="2", FragmentB="*")
simplegrid_4 = CreateSimpleGrid(UIElements=entwine_10, RowDefinitions=concat_5, ColumnDefinitions="3*")
adjustpos_4 = AdjustElementPositioning(ElementsToAdjust=entwine_10, AbsolutePositioning=False, HorizontalAlignment=3, VerticalAlignment=1)

gate_6 = StreamGate(Stream=textbox_7, Gate=reset_6)  # -> Target0, Target1
settextbox_10 = SetTextBoxContents(TextBoxToModify=gate_6.Target0, NewTextBoxContents=merge_39)

gate_7 = StreamGate(Stream=textbox_9, Gate=reset_5)  # -> Target0, Target1
settextbox_11 = SetTextBoxContents(TextBoxToModify=gate_7.Target0, NewTextBoxContents=merge_36)

entwine_11 = Entwine(Branch00=label_7, Branch01=merge_32, FlattenInputs=True)
concat_6 = Concatenate(FragmentA="2", FragmentB="*")
simplegrid_5 = CreateSimpleGrid(UIElements=entwine_11, RowDefinitions=concat_6, ColumnDefinitions="3*")
adjustpos_5 = AdjustElementPositioning(ElementsToAdjust=entwine_11, AbsolutePositioning=False, HorizontalAlignment=3, VerticalAlignment=1)

entwine_12 = Entwine(Branch00=label_6, Branch01=textbox_6, FlattenInputs=True)
concat_7 = Concatenate(FragmentA="2", FragmentB="*")
simplegrid_6 = CreateSimpleGrid(UIElements=entwine_12, RowDefinitions=concat_7, ColumnDefinitions="3*")
adjustpos_6 = AdjustElementPositioning(ElementsToAdjust=entwine_12, AbsolutePositioning=False, HorizontalAlignment=3, VerticalAlignment=1)

entwine_13 = Entwine(Branch00=label_8, Branch01=textbox_8, FlattenInputs=True)
concat_8 = Concatenate(FragmentA="2", FragmentB="*")
simplegrid_7 = CreateSimpleGrid(UIElements=entwine_13, RowDefinitions=concat_8, ColumnDefinitions="3*")
adjustpos_7 = AdjustElementPositioning(ElementsToAdjust=entwine_13, AbsolutePositioning=False, HorizontalAlignment=3, VerticalAlignment=1)

entwine_14 = Entwine(Branch00=label_9, Branch01=textbox_9, FlattenInputs=True)
concat_9 = Concatenate(FragmentA="2", FragmentB="*")
simplegrid_8 = CreateSimpleGrid(UIElements=entwine_14, RowDefinitions=concat_9, ColumnDefinitions="3*")
adjustpos_8 = AdjustElementPositioning(ElementsToAdjust=entwine_14, AbsolutePositioning=False, HorizontalAlignment=3, VerticalAlignment=1)

gate_8 = StreamGate(Stream=textbox_12, Gate=reset_7)  # -> Target0, Target1
settextbox_12 = SetTextBoxContents(TextBoxToModify=gate_8.Target0, NewTextBoxContents=merge_40)

entwine_15 = Entwine(Branch00=label_10, Branch01=textbox_12, FlattenInputs=True)
concat_10 = Concatenate(FragmentA="2", FragmentB="*")
simplegrid_9 = CreateSimpleGrid(UIElements=entwine_15, RowDefinitions=concat_10, ColumnDefinitions="3*")
adjustpos_9 = AdjustElementPositioning(ElementsToAdjust=entwine_15, AbsolutePositioning=False, HorizontalAlignment=3, VerticalAlignment=1)

slicemode_4 = RemoteReceiver(slicemode)
ui_planar_2 = RemoteReceiver(ui_planar)
uimodeselectcontents_2 = RemoteReceiver(uimodeselectcontents)
bang_11 = ExplodeTree(Data=graft(uimodeselectcontents_2))  # -> Branch0, Branch1
expander_3 = CreateExpander(UIElements=ui_planar_2, Header=bang_11.Branch1, Open=True)
invbool = InvertBoolean(Boolean=slicemode_4)  # -> Inverted, Number
setexp_3 = SetExpander(Expander=expander_3, ExpandedOpen=slicemode_4)

layerpitchdomain_2 = RemoteReceiver(layerpitchdomain)
settextblock = SetTextBlockContents(TextBlockToModify=tb, NewTextBlockContents=layerpitchdomain_2)
uislicemodeselect = RemoteSender(simplegrid_3)
uinonplanar = RemoteSender(simplegrid_2)
values_17 = ValueListener(Elements=simplegrid_4, Trigger=gcodepreview_3, SomeProperty=False)  # -> flatten(Values), Indices
values_18 = ValueListener(Elements=simplegrid_8, Trigger=gcodepreview_4, SomeProperty=False)  # -> flatten(Values), Indices
values_19 = ValueListener(Elements=simplegrid_6, Trigger=gcodepreview_6, SomeProperty=False)  # -> flatten(Values), Indices
lng = ListLength(List=values_17.Values)
values_20 = ValueListener(Elements=simplegrid_5, Trigger=gcodepreview_5, SomeProperty=False)  # -> flatten(Values), Indices
panel_24 = Panel(values_18.Values)
division = Division(A=lng, B=2)
lng_2 = ListLength(List=values_19.Values)
values_21 = ValueListener(Elements=simplegrid_7, Trigger=gcodepreview_7, SomeProperty=False)  # -> flatten(Values), Indices
lng_3 = ListLength(List=values_20.Values)
lng_4 = ListLength(List=values_18.Values)
split = SplitList(List=values_17.Values, Index=division)  # -> ListA, graft(ListB)
division_2 = Division(A=lng_2, B=2)
division_3 = Division(A=lng_3, B=2)
division_4 = Division(A=lng_4, B=2)
lng_5 = ListLength(List=values_21.Values)
bang_12 = ExplodeTree(Data=split.ListB)  # -> Branch0, Branch1, Branch2
split_2 = SplitList(List=values_19.Values, Index=division_2)  # -> ListA, graft(ListB)
split_3 = SplitList(List=values_20.Values, Index=division_3)  # -> ListA, graft(ListB)
split_4 = SplitList(List=values_18.Values, Index=division_4)  # -> ListA, graft(ListB)
division_5 = Division(A=lng_5, B=2)
split_5 = SplitList(List=values_21.Values, Index=division_5)  # -> ListA, graft(ListB)
bang_13 = ExplodeTree(Data=split_2.ListB)  # -> Branch0, Branch1, Branch2
nozzlediameter = RemoteSender(bang_12.Branch1)
filamentdiameter = RemoteSender(bang_12.Branch0)
panel_25 = Panel(split_5.ListB)
multipliar = RemoteSender(bang_12.Branch2)
bang_14 = ExplodeTree(Data=split_3.ListB)  # -> Branch0, Branch1, Branch2
int = Integer(split_5.ListB)
uinozzle = RemoteSender(simplegrid_4)
bang_15 = ExplodeTree(Data=split_4.ListB)  # -> Branch0, Branch1, Branch2
printspeed = RemoteSender(bang_13.Branch0)
uispeed = RemoteSender(simplegrid_6)
bang_16 = ExplodeTree(Data=int)  # -> Branch0, Branch1
ui_firstlayerpitch = RemoteSender(simplegrid_8)
firstlayermulti = RemoteSender(bang_15.Branch1)
firstlayerpitch = RemoteSender(bang_15.Branch0)
brimbool = RemoteSender(bang_14.Branch2)
uibrim = RemoteSender(simplegrid_5)
brimcount = RemoteSender(bang_14.Branch0)
width = RemoteSender(bang_14.Branch1)
retractionspeed = RemoteSender(bang_16.Branch1)
retraction = RemoteSender(bang_16.Branch0)
uiretraction = RemoteSender(simplegrid_7)
values_22 = ValueListener(Elements=simplegrid_9, SomeProperty=True)  # -> flatten(Values), Indices
lng_6 = ListLength(List=values_22.Values)
division_6 = Division(A=lng_6, B=2)
split_6 = SplitList(List=values_22.Values, Index=division_6)  # -> ListA, graft(ListB)
bang_17 = ExplodeTree(Data=split_6.ListB)  # -> Branch0, Branch1
vec_2 = VectorXYZ(XComponent=bang_17.Branch0, YComponent=bang_17.Branch1, ZComponent=0)  # -> Vector, Length
uiposition = RemoteSender(simplegrid_9)
position = RemoteSender(vec_2.Vector)
ui_firstlayerpitch_2 = RemoteReceiver(ui_firstlayerpitch)
uiretraction_2 = RemoteReceiver(uiretraction)
uiposition_2 = RemoteReceiver(uiposition)
uinozzle_2 = RemoteReceiver(uinozzle)
uispeed_2 = RemoteReceiver(uispeed)
uibrim_2 = RemoteReceiver(uibrim)
uislicemodeselect_2 = RemoteReceiver(uislicemodeselect)
entwine_16 = Entwine(Branch00=uiposition_2, Branch01=uisavefile_2, FlattenInputs=True)
entwine_17 = Entwine(
    Branch00=uisavefile_2,
    Branch01=uiposition_2,
    Branch02=uijson_2,
    Branch03=uiselectprofile_2,
    Branch04=ui_firstlayerpitch_2,
    Branch05=uinozzle_2,
    Branch06=uispeed_2,
    Branch07=uibrim_2,
    Branch08=uiretraction_2,
    FlattenInputs=True)
expander_4 = CreateExpander(UIElements=entwine_17, Header=entwine_7, Open=True)  # -> flatten(Expander)
expander_5 = CreateExpander(UIElements=entwine_16, Header=entwine_6, Open=True)  # -> flatten(Expander); disabled
expander_6 = CreateExpander(UIElements=uislicemodeselect_2, Header=uislicename_2, Open=True)  # -> flatten(Expander)
setexp_4 = SetExpander(Expander=expander_4, ExpandedOpen=True)
setexp_5 = SetExpander(Expander=expander_5, ExpandedOpen=True)  # disabled
setexp_6 = SetExpander(Expander=expander_6, ExpandedOpen=Toggle(True))

firstlayerpitch_2 = RemoteReceiver(firstlayerpitch)
slicemodel = SliceModel(firstlayerpitch=firstlayerpitch_2, layerpitch=layerpitch_2, seemposition=Slider(0.1, range=0..0.1), mesh=geo_3)
planartoolpath = RemoteSender(slicemodel)

uinonplanar_2 = RemoteReceiver(uinonplanar)
expander_7 = CreateExpander(UIElements=uinonplanar_2, Header=bang_11.Branch0, Open=True)
entwine_18 = Entwine(Branch00=expander_7, Branch01=expander_3, FlattenInputs=True)  # -> flatten(Result)
setexp_7 = SetExpander(Expander=expander_7, ExpandedOpen=invbool.Inverted)
uislicemode = RemoteSender(entwine_18)

planartoolpath_2 = RemoteReceiver(planartoolpath)
filter_17 = StreamFilter(Gate=slicemode_2, Stream0=nptoolpath_2, Stream1=planartoolpath_2)
firstlayerpitch_3 = RemoteReceiver(firstlayerpitch)
toolpath = RemoteSender(filter_17)
toolpath_2 = RemoteReceiver(toolpath)
firstlayerpitch_4 = RemoteReceiver(firstlayerpitch)
firstlayermulti_2 = RemoteReceiver(firstlayermulti)
printspeed_2 = RemoteReceiver(printspeed)
brimcount_2 = RemoteReceiver(brimcount)
brimbool_2 = RemoteReceiver(brimbool)
toolpath_3 = RemoteReceiver(toolpath)
width_2 = RemoteReceiver(width)
cluster_10 = Cluster_6(crv=toolpath_2, G=divideoption_2, B=segmentlength_2)
printspeed_3 = RemoteReceiver(printspeed)
firstlayerpitch_5 = RemoteReceiver(firstlayerpitch)
firstlayermulti_3 = RemoteReceiver(firstlayermulti)
cluster_11 = Cluster_2(
    toolpath=toolpath_3,
    A=firstlayerpitch_4,
    multi=firstlayermulti_2,
    printspeed=printspeed_2,
    width=width_2,
    brimcounts=brimcount_2,
    relay=brimbool_2,
    space=Slider(0.5, range=0..1))  # -> xyz, layerpitch, F
cluster_12 = Cluster_5(
    printspeed_2=Slider(800, range=0..1000),
    spiral=spiralbool_2,
    printspeed=printspeed_3,
    firstlayerpitch=firstlayerpitch_5,
    firstlayermulti=firstlayermulti_3,
    layerpitch=layerpitch_3,
    contour_polyline=cluster_10,
    boolean=slicemode_3)  # -> xyz, abc_2, E, F, I
brim_xyz = RemoteSender(cluster_11.xyz)
brim_layerpitch = RemoteSender(cluster_11.layerpitch)
brim_f = RemoteSender(cluster_11.F)
spiral_xyz = RemoteSender(cluster_12.xyz)
spiral_xyz_2 = RemoteReceiver(spiral_xyz)
spiral_layerpitch = RemoteSender(cluster_12.E)
spiral_f = RemoteSender(cluster_12.F)
gate_9 = StreamGate(Stream=spiral_xyz_2, Gate=editcurvemode_2)  # -> Target0, Target1, Target2
nozzlediameter_2 = RemoteReceiver(nozzlediameter)
onebyone = OneByOne(relay=gate_9.Target1, amp=amplitude_2, D=textruedomain_2)  # -> simplify(L)
onebyone_2 = OneByOne_2(relay=gate_9.Target2, amp=amplitude_2, D=textruedomain_2)  # -> simplify(V), L
filter_18 = StreamFilter(Gate=editcurvemode_2, Stream0=gate_9.Target0, Stream1=onebyone, Stream2=onebyone_2.L)
pline = PolyLine(Vertices=onebyone_2.V, Closed=False)
edited_xyz = RemoteSender(filter_18)
spiral_layerpitch_2 = RemoteReceiver(spiral_layerpitch)
spiral_layerpitch_3 = RemoteReceiver(spiral_layerpitch)
brim_layerpitch_2 = RemoteReceiver(brim_layerpitch)
spiral_f_2 = RemoteReceiver(spiral_f)
edited_xyz_2 = RemoteReceiver(edited_xyz)
firstlayerpitch_6 = RemoteReceiver(firstlayerpitch)
brim_f_2 = RemoteReceiver(brim_f)
brim_xyz_2 = RemoteReceiver(brim_xyz)
nozzlediameter_3 = RemoteReceiver(nozzlediameter)
entwine_19 = Entwine(Branch00=brim_f_2, Branch01=spiral_f_2, FlattenInputs=True)
entwine_20 = Entwine(Branch00=brim_layerpitch_2, Branch01=spiral_layerpitch_3, FlattenInputs=True)
entwine_21 = Entwine(Branch00=brim_xyz_2, Branch01=edited_xyz_2, FlattenInputs=True)
Z = UnitZ(Factor=firstlayerpitch_6)
move_3 = Move(Geometry=entwine_21, Motion=Z)  # -> Geometry, Transform
pitch = RemoteSender(entwine_20)
position_2 = RemoteReceiver(position)
F = RemoteSender(entwine_19)
move_4 = Move(Geometry=move_3.Geometry, Motion=position_2)  # -> Geometry, Transform
pline_2 = PolyLine(Vertices=move_4.Geometry, Closed=False)
cluster_13 = Cluster_11(C=pline_2, B=printspeed_3)
cluster_14 = Cluster_8(C=flatten(pline_2), A=nozzlediameter_3, B=Slider(6, range=0..10))
panel_26 = Panel(cluster_13)
panel_27 = Panel(cluster_14)
xyz = RemoteSender(move_4.Geometry)
xyz_2 = RemoteReceiver(xyz)
pline_3 = PolyLine(Vertices=xyz_2, Closed=False)
explode = Explode(Curve=pline_3, Recursive=True)  # -> flatten(Segments), Vertices
meshpipe = GhPythonScript(crv=explode.Segments, diameter=nozzlediameter_2, segment=Slider(10, range=0..10))  # -> mesh; inputs crv: list of Curve
# ---------- meshpipe: Python ----------
__author__ = "okapi"
__version__ = "2022.09.09"


import rhinoscriptsyntax as rs
import Rhino.Geometry as rg
from ghpythonlib.parallel import run

radius = diameter/2

mesh = []
def const_pipe(crv):
    crv = rs.coercegeometry(crv)
    mesh.extend([rg.Mesh.CreateFromCurvePipe(crv,radius,segment,0,rg.MeshPipeCapStyle(3),False)])

if radius and segment:
    #paralell processing
    run(const_pipe,crv,True)
# ---------- end meshpipe ----------
preview = CustomPreview(Geometry=meshpipe, Material=ColourSwatch(SwatchColor=RGB(227, 227, 227)))
filamentdiameter_2 = RemoteReceiver(filamentdiameter)
retractionspeed_2 = RemoteReceiver(retractionspeed)
nozzlediameter_4 = RemoteReceiver(nozzlediameter)
multipliar_2 = RemoteReceiver(multipliar)
retraction_2 = RemoteReceiver(retraction)
pitch_2 = RemoteReceiver(pitch)
xyz_3 = RemoteReceiver(xyz)
F_2 = RemoteReceiver(F)
filamentdiameter_3 = RemoteReceiver(filamentdiameter)
retractionspeed_3 = RemoteReceiver(retractionspeed)
nozzlediameter_5 = RemoteReceiver(nozzlediameter)
firstlayerpitch_7 = RemoteReceiver(firstlayerpitch)
firstlayermulti_4 = RemoteReceiver(firstlayermulti)
printspeed_4 = RemoteReceiver(printspeed)
brimcount_3 = RemoteReceiver(brimcount)
retraction_3 = RemoteReceiver(retraction)
multipliar_3 = RemoteReceiver(multipliar)
brimbool_3 = RemoteReceiver(brimbool)
width_3 = RemoteReceiver(width)
entwine_22 = Entwine(
    Branch00=filename_3,
    Branch01=startscript_3,
    Branch02=endscript_3,
    Branch03=filepath_3,
    Branch04=retractionspeed_3,
    Branch05=filamentdiameter_3,
    Branch06=nozzlediameter_5,
    Branch07=multipliar_3,
    Branch08=retraction_3,
    Branch09=firstlayerpitch_7,
    Branch010=firstlayermulti_4,
    Branch011=printspeed_4,
    Branch012=width_3,
    Branch013=brimcount_3,
    Branch014=brimbool_3,
    FlattenInputs=True)  # -> flatten(Result)
rejsonkv_2 = SerializeKeysAndValues(Key=panel, Value=entwine_22)
panel_28 = Panel(rejsonkv_2)
xyztogcode_core = XYZtoGCODECore(
    projectName=filename_2,
    startScript=startscript_2,
    endScript=endscript_2,
    filePath=filepath_2,
    saveFile=savefile_2,
    XYZ=xyz_3,
    F=F_2,
    retractionSpeed=retractionspeed_2,
    filamentDiameter=filamentdiameter_2,
    nozzleDiameter=nozzlediameter_4,
    layerPitch=pitch_2,
    multiplier=multipliar_2,
    retraction=retraction_2,
    setting=rejsonkv_2)  # -> G1; inputs startScript: list, endScript: list, saveFile: Boolean, XYZ: tree of Point3d, F: tree, layerPitch: tree
# ---------- xyztogcode_core: Python ----------
__author__ = "okapi"
__version__ = "2022.05.30"

import rhinoscriptsyntax as rs
import math as ma
import os
import ghpythonlib.components as gh
import datetime
import json
dt_now = datetime.datetime.now()

xyzTree = []
fTree = []
G1 = []



def generateG1(xyz,fdia,ndia,pitch,multi,rlen,pspeed,rspeed):

    digit = 3
    digitE = 4
    digitF = 0
    
    rspeed = round(rspeed,digit)
    g1 = []
    distance = []
    speed = []
    sumE = []
    listLength = len(xyz)
    
    for i in range(0,listLength):
        if i == 0:
            sumE = 0
            g1.append("G92 E0")
            g1.append("G1 X{} Y{} Z{} E{} F{}".format(round(xyz[i][0],digit),round(xyz[i][1],digit),round(xyz[i][2],digit),sumE,round(rspeed)))
        else:
            if sumE > 60:
                g1.append("G92 E0")
                sumE = 0
            a = rs.Distance(xyz[i],xyz[i-1])*ndia*pitch[i]
            b = (fdia/2)*(fdia/2)*ma.pi
            e = a/b*multi
            sumE = sumE + e
            
            if i == 1:
                g1.append("G1 X{} Y{} Z{} E{} F{}".format(round(xyz[i][0],digit),round(xyz[i][1],digit),round(xyz[i][2],digit),round(sumE+rlen,digitE),round(float(pspeed[i]),digitF)))
            else:
                g1.append("G1 X{} Y{} Z{} E{} F{}".format(round(xyz[i][0],digit),round(xyz[i][1],digit),round(xyz[i][2],digit),round(sumE,digitE),round(float(pspeed[i]),digitF)))
#        g1.append("G1 X{} Y{} Z{} E{} F{}".format(round(xyz[i][0],digit),round(xyz[i][1],digit),round(xyz[i][2],digit),round(-rlen,digitE),round(pspeed[i],digitF)))
    return g1


def save(gcode,json_setting,path,name):
    files = os.listdir(path)
    files_file = [f for f in files if os.path.isfile(os.path.join(path, f))]
    number = int(len(files_file)/2)   
    fileName = ("0{0}_{1}_{2}{3}{4}".format(number,name,dt_now.year,dt_now.month,dt_now.day))
    path = path + '/'
    
    #save gcode
    Gcode ='\n'.join(gcode)
    file = open(path + fileName+ ".gcode", 'w')
    file.writelines(Gcode)
    file.close()
    
    #save setting
    file = open(path + fileName + ".json", 'w')
    file.write(json_setting)
    file.close()
#

def header_list(setting_str):
    setting_list = []
    setting_list.append(';This Gcode was generated by ToolPathDesigner')
    setting_dic = json.loads(setting_str)
    del setting_dic['startScript']
    del setting_dic['endScript']
    del setting_dic['filePath']
    for k in setting_dic.keys():
        setting_list.append((";{0} : {1}".format(k,setting_dic[k])))
    return setting_list

if saveFile:
    result = []
    header = header_list(setting)
    for i in header:
        G1.append(i)

    for i in startScript:
        G1.append(i)
        
    for i in range(len(XYZ.Branches)):
        result = generateG1((XYZ.Branches[i]),filamentDiameter,nozzleDiameter,layerPitch.Branches[i],multiplier,retraction,F.Branches[i],retractionSpeed)
        for j in result:
            G1.append(j)
            
    for i in endScript:
        G1.append(i)
        
    
    projectDir = filePath+projectName
    if not os.path.exists(projectDir):
        os.makedirs(projectDir)
        
    save(G1,setting,projectDir,projectName)



#    saveJson(json,filePath,projectName)
# ---------- end xyztogcode_core ----------

uislicemode_2 = RemoteReceiver(uislicemode)
entwine_23 = Entwine(Branch00=expander_6, Branch01=uislicemode_2, FlattenInputs=True)
tabs = TabbedView(
    TabNames=merge_43,
    TabTextSize=Slider(15, range=0..100),
    Tab0=flatten(expander_2),
    Tab1=flatten(entwine_23),
    Tab2=flatten(entwine_8),
    Tab3=flatten(expander_4))
settab = SetTabbedView(TabbedView=tabs)
addelems = AddElements(Window=launchwin, Elements=flatten(tabs), DoVLChecking=True)  # -> AddedElements, ElementNames

# ==== cluster QmeshToolpath
crv = ClusterInput()
relay = ClusterInput()
cluster = Cluster(relay=crv)
explode = Explode(Curve=cluster, Recursive=True)  # -> Segments, Vertices
flip = FlipMatrix(Data=explode.Vertices)
pline = PolyLine(Vertices=flip, Closed=False)  # -> simplify(flatten(Polyline))
len = Length(Curve=pline)  # -> flatten(Length)
bnd = Bounds(Numbers=flatten(len))
dedomain = DeconstructDomain(Domain=bnd)  # -> Start, End
division = Division(A=dedomain.End, B=relay)
int = Integer(division)
divide = DivideCurve(Curve=simplify(pline), Count=simplify(int), Kinks=False)  # -> simplify(Points), Tangents, Parameters
flip_2 = FlipMatrix(Data=divide.Points)
pline_2 = PolyLine(Vertices=flip_2, Closed=False)  # -> flatten(Polyline)
pline_3 = PolyLine(Vertices=divide.Points, Closed=False)  # -> flatten(Polyline)
explode_2 = Explode(Curve=pline_3, Recursive=True)  # -> flatten(Segments), Vertices
len_2 = Length(Curve=explode_2.Segments)
bnd_2 = Bounds(Numbers=len_2)
I = ClusterOutput(bnd_2)
toolpath = ClusterOutput(pline_2)

# ==== cluster Cluster_2
toolpath = ClusterInput()
item = ListItem(List=toolpath, Index="0", Wrap=True)
multi = ClusterInput()
A = ClusterInput()
printspeed = ClusterInput()
cir = Circle(Plane=PlaneXY(0, 0, 0), Radius=1)
width = ClusterInput()
brimcounts = ClusterInput()
space = ClusterInput()
multiplication = Multiplication(A=A, B=multi)
flip = FlipCurve(Curve=item, Guide=cir)  # -> Curve, Flag
number_slider = Slider(21, range=0..100)
series = Series(Start=width, Step=width, Count=brimcounts)
area = Area(Geometry=flip.Curve)  # -> Area, Centroid
rev = ReverseList(List=series)
geo = Geometry(area.Centroid)
end = EndPoints(Curve=flip.Curve)  # -> Start, End
bnd = Bounds(Numbers=series)
scale_nu = ScaleNU(Geometry=end.Start, Plane=area.Centroid, ScaleX=number_slider, ScaleY=number_slider, ScaleZ=1)  # -> Geometry, Transform
dedomain = DeconstructDomain(Domain=bnd)  # -> Start, End
polyoffset = PolylineOffset(
    Polylines=flip.Curve,
    Distance=space,
    Plane=Plane(origin=(0, 0, 0), x=(0, 0, 0), y=(0, 0, 0)),
    Tolerance=0.001,
    ClosedFillet=1,
    OpenFillet=1,
    Miter=2)  # -> Contour, Holes
relay = ClusterInput()
filter = StreamFilter(Gate=relay, Stream0=polyoffset.Contour, Stream1=polyoffset.Holes)
polyoffset_2 = PolylineOffset(
    Polylines=filter,
    Distance=rev,
    Plane=Plane(origin=(0, 0, 0), x=(0, 0, 0), y=(0, 0, 0)),
    Tolerance=0.001,
    ClosedFillet=1,
    OpenFillet=1,
    Miter=2)  # -> Contour, Holes
filter_2 = StreamFilter(Gate=relay, Stream0=polyoffset_2.Contour, Stream1=polyoffset_2.Holes)
addition = Addition(A=dedomain.End, B=2)
crv_cp = CurveClosestPoint(Point=scale_nu.Geometry, Curve=simplify(filter_2))  # -> Point, Parameter, Distance
shatter = Shatter(Curve=filter_2, Parameters=crv_cp.Parameter)
geo_2 = Geometry(shatter)
disc = Discontinuity(Curve=geo_2, Level=2)  # -> Points, Parameters
duppt = RemoveDuplicatePts(Points=disc.Points, Tolerance=0.01)
item_2 = ListItem(List=duppt, Index=0, Wrap=True)
ins = InsertItems(List=duppt, Item=item_2, Indices="-1", Wrap=True)  # -> flatten(List)
tstat = TreeStatistics(Tree=ins)  # -> Paths, Length, Count
tstat_2 = TreeStatistics(Tree=ins)  # -> Paths, Length, Count
dup = DuplicateData(Data=printspeed, Number=tstat_2.Length, Order=True)
dup_2 = DuplicateData(Data=multiplication, Number=tstat.Length, Order=True)
xyz = ClusterOutput(ins)
F = ClusterOutput(dup)
layerpitch = ClusterOutput(dup_2)

# ==== cluster Cluster_3
relay = ClusterInput()
_1 = ClusterInput()
null = NullItem(Item=relay)  # -> NullFlags, InvalidFlags, Description
filter = StreamFilter(Gate=null.NullFlags, Stream0=relay, Stream1=_1)
s_1 = ClusterOutput(filter)

# ==== cluster Cluster_4
name = ClusterInput()
data = ClusterInput()

entwine = Entwine(Branch00=name, Branch01=data, FlattenInputs=True)
concat = Concatenate(FragmentA="2", FragmentB="*")
simplegrid = CreateSimpleGrid(UIElements=entwine, RowDefinitions=concat, ColumnDefinitions="3*")
adjustpos = AdjustElementPositioning(ElementsToAdjust=entwine, AbsolutePositioning=False, HorizontalAlignment=3, VerticalAlignment=1)

S = ClusterOutput(simplegrid)

# ==== cluster SliceModel
layerpitch = ClusterInput()
seemposition = ClusterInput()
mesh = ClusterInput()
bounding_box = BoundingBox(Content=mesh, Plane=PlaneXY(0, 0, 0))  # -> Box, Box_2
firstlayerpitch = ClusterInput()
panel = Panel("""高さの値抽出後、スタート値とエンド値を引き算
モデル本体の高さを求める""")
deconstruct_box = DeconstructBox(Box=bounding_box.Box)  # -> Plane, X, Y, Z
deconstruct_domain = DeconstructDomain(Domain=deconstruct_box.Z)  # -> Start, End
subtraction = Subtraction(A=deconstruct_domain.End, B=deconstruct_domain.Start)
division = Division(A=subtraction, B=layerpitch)
panel_2 = Panel("""積層データリスト作成
ベッドからの距離""")
duplicate_data = DuplicateData(Data=layerpitch, Number=division, Order=True)
replace_items = ReplaceItems(List=duplicate_data, Item=firstlayerpitch, Indices="0", Wrap=False)  # -> flatten(List)
contour_ex = ContourEx(Shape=mesh, Plane=PlaneXY(0, 0, 0), Distances=replace_items)  # -> simplify(Contours)
path = ConstructPath()
cull_i = CullIndex(Wrap=True)
join = JoinCurves(Curves=contour_ex, Preserve=False)
divide = DivideCurve(Curve=join, Count=Slider(200, range=0..1000), Kinks=False)  # -> Points, Tangents, Parameters
pline = PolyLine(Vertices=divide.Points, Closed=True)
tstat = TreeStatistics(Tree=pline)  # -> Paths, Length, Count
item = ListItem(List=tstat.Paths, Index=-1, Wrap=True)
split = SplitTree(Data=pline, Masks=flatten(item))  # -> Positive, flatten(Negative)
item_2 = ListItem(List=split.Negative, Index=-1, Wrap=True)
end = EndPoints(Curve=item_2)  # -> Start, End
crv_cp = CurveClosestPoint(Point=end.Start, Curve=reparameterize(split.Negative))  # -> Point, Parameter, Distance
seam = Seam(Curve=reparameterize(split.Negative), Seam=crv_cp.Parameter)
end_2 = EndPoints(Curve=seam)  # -> Start, End
C = ClusterOutput(seam)

# ==== cluster Cluster_5
contour_polyline = ClusterInput()
spiral = ClusterInput()
item = ListItem(List=contour_polyline, Index=0, Wrap=True)
flip = FlipCurve(Curve=contour_polyline, Guide=item)  # -> Curve, Flag
c_script = CSharpScript(inputPolyline=flip.Curve)  # -> out, graft(C); inputs inputPolyline: list of Polyline
# ---------- c_script: C# usings ----------
using System.Linq;
# ---------- c_script: C# ----------
    //List<Polyline> spiralToolPaths = new List<Polyline>();
    C = spiralToolPaths(inputPolyline);
# ---------- c_script: C# additional code ----------
  float maxSegmentLength(List<Polyline> pLine)
  {
    List<float> segInAll = new List<float>();
    float maxLenInLayer;
    float maxLenInAll;
    for (int i = 0; i < pLine.Count; i++)
    {
      List<float> segInLayer = new List<float>();
      for (int j = 0; j < pLine[i].SegmentCount; j++)
      {
        segInLayer.Add((float) (pLine[i].SegmentAt(j)).Length);
      }
      maxLenInLayer = segInLayer.Max();
      segInAll.Add(maxLenInLayer);
    }
    maxLenInAll = segInAll.Max();
    return maxLenInAll;
  }

  List<float> range(float count)
  {
    List<float> rangeList = new List<float>();
    for(int i = 0; i < count; i++)
    {
      rangeList.Add(i / (count - 1));
    }
    return rangeList;
  }

  List<Polyline> spiralToolPaths(List<Polyline> pLine)
  {
    List<Polyline> spiralToolPaths = new List<Polyline>();
    for(int i = 0; i < pLine.Count - 1; i++)
    {
      List<Point3d> points = new List<Point3d>();

      List<float> tParam = new List<float>();
      tParam = range(pLine[0].Count);



      for(int j = 0; j < pLine[i].Count; j++)
      {
        Line cv = new Line();
        cv = new Line(pLine[i][j], pLine[i + 1][j]);

        Point3d newPt = new Point3d();
        newPt = cv.PointAt(tParam[j]);
        points.Add(newPt);


      }

      Polyline spiral = new Polyline();
      spiral = new Polyline(points);
      spiralToolPaths.Add(spiral);


    }
    return spiralToolPaths;
  }
# ---------- end c_script ----------
c_script_2 = CSharpScript(inputPolyline=flip.Curve)  # -> out, graft(C); inputs inputPolyline: list of Polyline
# ---------- c_script_2: C# ----------
    List<Polyline> spiralToolPaths = new List<Polyline>();
    for(int i = 0; i < inputPolyline.Count - 1; i++)
    {
      List<Point3d> points = new List<Point3d>();

      List<float> tParam = new List<float>();
      tParam = range(inputPolyline[0].Count);
      


      for(int j = 0; j < inputPolyline[i].Count; j++)
      {
        Line cv = new Line();
        cv = new Line(inputPolyline[i][j], inputPolyline[i + 1][j]);
        
        Point3d newPt = new Point3d();
        newPt = cv.PointAt(tParam[j]);
        points.Add(newPt);
        

      }
      
      Polyline spiral = new Polyline();
      spiral = new Polyline(points);
      spiralToolPaths.Add(spiral);
      
      
    }
    C = spiralToolPaths;
    //C = maxSegmentLength(inputPolyline);
# ---------- c_script_2: C# additional code ----------
  float maxSegmentLength(List<Polyline> pLine)
  {
    List<float> segInAll = new List<float>();
    float maxLenInLayer;
    float maxLenInAll;
    for (int i = 0; i < pLine.Count; i++)
    {
      List<float> segInLayer = new List<float>();
      for (int j = 0; j < pLine[i].SegmentCount; j++)
      {
        segInLayer.Add((float) (pLine[i].SegmentAt(j)).Length);
      }
      maxLenInLayer = segInLayer.Max();
      segInAll.Add(maxLenInLayer);
    }
    maxLenInAll = segInAll.Max();
    return maxLenInAll;
  }

  List<float> range(float count)
  {
    List<float> rangeList = new List<float>();
    for(int i = 0; i < count; i++)
    {
      rangeList.Add(i / (count - 1));
    }
    return rangeList;
  }
# ---------- end c_script_2 ----------
c_script_3 = CSharpScript(polyline=flip.Curve)  # -> out, pitch, A; inputs polyline: list of Polyline
# ---------- c_script_3: C# ----------
    List<Polyline> middlePolylines = new List<Polyline>(polyline);
# ---------- c_script_3: C# additional code ----------
  List<Polyline> bottomPolyline (List<Polyline> originPolyline)
  {
    List<Polyline> bottom = new List<Polyline>();
    bottom.Add(originPolyline[0]);
    return bottom;
  }

  List<Polyline> middlePolyline (List<Polyline> originPolyline)
  {

    List<Polyline> origin = new List<Polyline>(originPolyline);
    //Polyline bottom = new Polyline();
    origin.RemoveAt(0);
    origin.RemoveAt(origin.Count - 1);
    return origin;
  }

  List<Polyline> topPolyline (List<Polyline> originPolyline)
  {
    List<Polyline> top = new List<Polyline>();
    top.Add(originPolyline[originPolyline.Count - 1]);
    return top;
  }
# ---------- end c_script_3 ----------
cull_i = CullIndex(List=flip.Curve, Indices=[0, -1], Wrap=True)
explode = Explode(Curve=simplify(c_script_2.C), Recursive=True)  # -> Segments, Vertices
panel = Panel(c_script.C)
explode_2 = Explode(Curve=cull_i, Recursive=True)  # -> Segments, Vertices
filter = StreamFilter(Gate=spiral, Stream0=explode_2.Vertices, Stream1=explode.Vertices)  # -> simplify(Stream)

item_2 = ListItem(List=flip.Curve, Index="-1", Wrap=True)

item_3 = ListItem(List=flip.Curve, Index="0", Wrap=True)

explode_3 = Explode(Curve=item_3, Recursive=True)  # -> Segments, Vertices
explode_4 = Explode(Curve=item_2, Recursive=True)  # -> Segments, Vertices
c_script_4 = CSharpScript(bottom=explode_3.Vertices)  # -> out, A; inputs bottom: list of Point3d
# ---------- c_script_4: C# ----------
    Polyline bottomPolyline = new Polyline();
    bottomPolyline = new Polyline(bottom);

    A = bottomPolyline;
# ---------- end c_script_4 ----------
c_script_5 = CSharpScript(polyline=flip.Curve, spiralPolyline=flatten(c_script_2.C))  # -> out, pitch, A; inputs polyline: list of Polyline, spiralPolyline: list of Polyline
# ---------- c_script_5: C# ----------
    
    List<Polyline> bottomPolylines = new List<Polyline>(bottomPolyline(polyline));
    List<Polyline> middlePolylines = new List<Polyline>(spiralPolyline);
    List<Polyline> topPolylines = new List<Polyline>(topPolyline(polyline));

    //upperPolyines
    List<Polyline> upperPolylines = new List<Polyline>(middlePolylines);
    upperPolylines.AddRange(topPolylines);
    upperPolylines.AddRange(topPolylines);
    
    //underPolylines
    List<Polyline> underPolylines = new List<Polyline>(bottomPolylines);
    underPolylines.AddRange(middlePolylines);
    underPolylines.AddRange(topPolylines);


    var pitchList = new DataTree<Double>();

    for(int i = 0; i < underPolylines.Count; i++)
    {
      var path = new GH_Path(i);
      for(int j = 0; j < upperPolylines[i].Count; j++)
      {
        //pitchLine.Add(new Line(upperPolylines[i][j], underPolylines[i].ClosestPoint(upperPolylines[i][j])), path);
        pitchList.Add(upperPolylines[i][j].DistanceTo(underPolylines[i].ClosestPoint(upperPolylines[i][j])), path);
      }

      pitch = pitchList;
    }
# ---------- c_script_5: C# additional code ----------
  List<Polyline> bottomPolyline (List<Polyline> originPolyline)
  {
    List<Polyline> bottom = new List<Polyline>();
    bottom.Add(originPolyline[0]);
    return bottom;
  }

  List<Polyline> middlePolyline (List<Polyline> originPolyline)
  {

    List<Polyline> origin = new List<Polyline>(originPolyline);
    //Polyline bottom = new Polyline();
    origin.RemoveAt(0);
    origin.RemoveAt(origin.Count - 1);
    return origin;
  }

  List<Polyline> topPolyline (List<Polyline> originPolyline)
  {
    List<Polyline> top = new List<Polyline>();
    top.Add(originPolyline[originPolyline.Count - 1]);
    return top;
  }
# ---------- end c_script_5 ----------
bnd = Bounds(Numbers=flatten(c_script_5.pitch))
firstlayermulti = ClusterInput()
firstlayerpitch = ClusterInput()
pline = PolyLine(Vertices=explode_4.Vertices, Closed=False)  # -> flatten(Polyline)
pline_2 = PolyLine(Vertices=explode_3.Vertices, Closed=False)  # -> flatten(Polyline)
pline_3 = PolyLine(Vertices=filter, Closed=False)  # -> flatten(Polyline)
layerpitch = ClusterInput()
boolean = ClusterInput()
printspeed = ClusterInput()
multiplication = Multiplication(A=firstlayerpitch, B=firstlayermulti)
printspeed_2 = ClusterInput()
merge = Merge(Data1=pline_2, Data2=pline_3, Data3=pline)  # -> graft(Result)
len = Length(Curve=merge)
bnd_2 = Bounds(Numbers=flatten(len))
dom = ConstructDomain(DomainStart=printspeed_2, DomainEnd=printspeed)
remap = RemapNumbers(Value=len, Source=bnd_2, Target=dom)  # -> simplify(graft(Mapped)), Clipped
abc = Relay()
tstat = TreeStatistics(Tree=explode_3.Vertices)  # -> Paths, Length, Count
tstat_2 = TreeStatistics(Tree=explode_3.Vertices)  # -> Paths, Length, Count
dup = DuplicateData(Data=Slider(800, range=0..1000), Number=tstat.Length, Order=True)  # -> flatten(Data)
python = GhPythonScript(v=abc)  # -> rx, ry, rz; inputs v: Vector3d
# ---------- python: Python ----------
__author__ = "okapi"
__version__ = "2022.07.01"

import rhinoscriptsyntax as rs
import math


x = v[0]
y = v[1]
z = v[2]

if y==0 and z==0:
    rx = 0
else:
    rx = round(math.degrees(math.atan2(y*-1,z)),3)
    
if x==0 and z==0:
    ry = 0
else:
    ry = round(math.degrees(math.atan2(x,z)),3)
rz = 15
# ---------- end python ----------
dup_2 = DuplicateData(Data="{0,0,15}", Number=tstat_2.Length, Order=True)  # -> flatten(Data)
merge_2 = Merge(Data1=pline_3, Data2=pline)  # -> graft(Result)
vec = VectorXYZ(XComponent=python.rx, YComponent=python.ry, ZComponent=python.rz)  # -> Vector, Length
entwine = Entwine(Branch00=dup, Branch01=printspeed, FlattenInputs=True)  # -> flatten(Result)
entwine_2 = Entwine(Branch00=dup_2, Branch01=vec.Vector, FlattenInputs=True)  # -> flatten(Result)
explode_5 = Explode(Curve=merge, Recursive=True)  # -> Segments, Vertices
tstat_3 = TreeStatistics(Tree=explode_5.Vertices)  # -> Paths, Length, Count
dup_3 = DuplicateData(Data=graft(remap.Mapped), Number=graft(tstat_3.Length), Order=True)  # -> simplify(Data)
unflatten = UnflattenTree(Tree=dup_3, Guide=explode_5.Vertices)
explode_6 = Explode(Curve=merge_2, Recursive=True)  # -> Segments, Vertices
tstat_4 = TreeStatistics(Tree=explode_6.Vertices)  # -> Paths, Length, Count
tstat_5 = TreeStatistics(Tree=explode_3.Vertices)  # -> Paths, Length, Count
split = SplitTree(Data=tstat_4.Length, Masks=flatten("{0}"))  # -> Positive, Negative
ma = MassAddition(Input=split.Negative)  # -> Result, PartialResults
dup_4 = DuplicateData(Data=multiplication, Number=tstat_5.Length, Order=True)
dup_5 = DuplicateData(Data=layerpitch, Number=tstat_4.Length, Order=True)
filter_2 = StreamFilter(Gate=boolean, Stream0=c_script_5.pitch, Stream1=dup_5)
entwine_3 = Entwine(Branch00=dup_4, Branch01=filter_2, FlattenInputs=True)  # -> flatten(Result)
unflatten_2 = UnflattenTree(Tree=entwine_3, Guide=explode_5.Vertices)
geo = Geometry(explode_5.Vertices)
bnd_3 = Bounds(Numbers=bnd)
xyz = ClusterOutput(explode_5.Vertices)
E = ClusterOutput(unflatten_2)
abc_2 = ClusterOutput(entwine_2)
F = ClusterOutput(unflatten)
I = ClusterOutput(bnd_3)

# ==== cluster CurveToXYZF
crv = ClusterInput()
relay = ClusterInput()
relay_2 = ClusterInput()
relay_3 = ClusterInput()
D = ClusterInput()
crv_2 = Curve(reparameterize(crv))
gate = StreamGate(Stream=crv_2, Gate=relay_3)  # -> Target0, Target1
opncrv = OpenCurve(Curve=gate.Target1, Length=0.001, Normalized=False, Seam=0)  # -> Opened, R
disc = Discontinuity(Curve=gate.Target0, Level=1)  # -> simplify(Points), Parameters
divide = DivideCurve(Curve=opncrv.Opened, Count=relay, Kinks=False)  # -> simplify(Points), Tangents, Parameters
item = ListItem(List=disc.Points, Index=0, Wrap=False)
item_2 = ListItem(List=divide.Points, Index=0, Wrap=True)
ins = InsertItems(List=disc.Points, Item=item, Indices="-1", Wrap=True)  # -> simplify(List)
ins_2 = InsertItems(List=divide.Points, Item=item_2, Indices="-1", Wrap=True)  # -> simplify(List)
filter = StreamFilter(Gate=relay_3, Stream0=ins, Stream1=ins_2)
tstat = TreeStatistics(Tree=filter)  # -> Paths, Length, Count
tstat_2 = TreeStatistics(Tree=filter)  # -> Paths, Length, Count
dup = DuplicateData(Data=relay_2, Number=tstat_2.Length, Order=True)  # -> simplify(Data)
dup_2 = DuplicateData(Data=D, Number=tstat.Length, Order=True)  # -> simplify(Data)
D_2 = ClusterOutput(dup)
s_0 = ClusterOutput(filter)
D_3 = ClusterOutput(dup_2)

# ==== cluster OneByOne
amp = ClusterInput()
relay = ClusterInput()
Z = UnitZ(Factor=relay)
panel = Panel("""true
false""")
panel_2 = Panel("""false
true""")
intcrv = Interpolate(Vertices=relay, Degree=3, Periodic=False, KnotStyle=1)  # -> Curve, Length, Domain
crv_cp = CurveClosestPoint(Point=relay, Curve=intcrv.Curve)  # -> Point, Parameter, Distance
bool = Boolean(panel_2)
bool_2 = Boolean(panel)
eval = EvaluateCurve(Curve=intcrv.Curve, Parameter=crv_cp.Parameter)  # -> Point, Tangent, Angle
sift = SiftPattern(List=relay, SiftPattern=bool)  # -> Output0, Output1
vrot = Rotate(Vector=eval.Tangent, Axis=Z, Angle=degrees(Slider(90, range=0..100)))
sift_2 = SiftPattern(List=relay, SiftPattern=bool_2)  # -> Output0, Output1
flip = FlipMatrix(Data=sift.Output0)
flip_2 = FlipMatrix(Data=sift.Output1)
flip_3 = FlipMatrix(Data=sift_2.Output0)
flip_4 = FlipMatrix(Data=sift_2.Output1)
sift_3 = SiftPattern(List=flip, SiftPattern=bool)  # -> Output0, Output1
unit = UnitVector(Vector=vrot)
amp_2 = Amplitude(Vector=unit, Amplitude=amp)
sift_4 = SiftPattern(List=flip_2, SiftPattern=bool)  # -> Output0, Output1
devec = DeconstructVector(Vector=amp_2)  # -> XComponent, YComponent, ZComponent
sift_5 = SiftPattern(List=flip_3, SiftPattern=bool_2)  # -> Output0, Output1
combine = CombineData(Input0=sift_3.Output0, Input1=sift_5.Output0)  # -> Result, Index
sift_6 = SiftPattern(List=flip_4, SiftPattern=bool_2)  # -> Output0, Output1
vec = VectorXYZ(XComponent=devec.XComponent, YComponent=devec.YComponent, ZComponent=0)  # -> Vector, Length
null = NullItem(Item=combine.Result)  # -> NullFlags, InvalidFlags, Description
combine_2 = CombineData(Input0=sift_4.Output0, Input1=sift_6.Output0)  # -> Result, Index
move = Move(Geometry=relay, Motion=vec.Vector)  # -> Geometry, Transform
dispatch = Dispatch(List=combine.Result, DispatchPattern=null.NullFlags)  # -> ListA, ListB
bool_3 = Boolean(panel_2)
bool_4 = Boolean(panel)
sift_7 = SiftPattern(List=move.Geometry, SiftPattern=bool_3)  # -> Output0, Output1
geo = Geometry(relay)
sift_8 = SiftPattern(List=move.Geometry, SiftPattern=bool_4)  # -> Output0, Output1
D = ClusterInput()
flip_5 = FlipMatrix(Data=sift_7.Output0)
flip_6 = FlipMatrix(Data=sift_7.Output1)
flip_7 = FlipMatrix(Data=sift_8.Output0)
flip_8 = FlipMatrix(Data=sift_8.Output1)
sift_9 = SiftPattern(List=flip_5, SiftPattern=bool_3)  # -> Output0, Output1
sift_10 = SiftPattern(List=flip_6, SiftPattern=bool_3)  # -> Output0, Output1
sift_11 = SiftPattern(List=flip_7, SiftPattern=bool_4)  # -> Output0, Output1
sift_12 = SiftPattern(List=flip_8, SiftPattern=bool_4)  # -> Output0, Output1
combine_3 = CombineData(Input0=sift_9.Output0, Input1=sift_11.Output0)  # -> Result, Index
null_2 = NullItem(Item=combine_3.Result)  # -> NullFlags, InvalidFlags, Description
combine_4 = CombineData(Input0=sift_10.Output0, Input1=sift_12.Output0)  # -> Result, Index
number_slider = Slider(2, range=0..10)
dispatch_2 = Dispatch(List=combine_3.Result, DispatchPattern=null_2.NullFlags)  # -> ListA, ListB
weave = Weave(Pattern=null.NullFlags, Stream0=dispatch_2.ListB, Stream1=dispatch.ListA, NullGaps=False)
combine_5 = CombineData(Input0=weave, Input1=combine_2.Result)  # -> Result, Index
flip_9 = FlipMatrix(Data=combine_5.Result)
pline = PolyLine(Vertices=flatten(flip_9), Closed=False)
explode = Explode(Curve=pline, Recursive=True)  # -> Segments, Vertices
subset = SubList(List=explode.Vertices, Domain=D, Wrap=True)  # -> List, Index
item = ListItem(List=flatten(relay), Index=subset.Index, Wrap=True)
replace = ReplaceItems(List=explode.Vertices, Item=item, Indices=subset.Index, Wrap=False)
L = ClusterOutput(replace)
mpipe = MeshPipe(
    Curve=explode.Segments,
    Radius=Slider(2, range=0..10),
    Segments=Slider(6, range=0..10),
    Accuracy=1,
    CapType=0,
    Faceted=False)  # disabled
preview = CustomPreview(
    Geometry=mpipe,
    Material={diffuse=RGB(221, 160, 221), emission=RGB(66, 48, 66), shine=0.5, specular=RGB(255, 255, 255), transparency=0})  # disabled

# ==== cluster Cluster_6
crv = ClusterInput()
G = ClusterInput()
gate = StreamGate(Stream=crv, Gate=G)  # -> Target0, Target1
B = ClusterInput()
len = Length(Curve=gate.Target1)
geo = Geometry(gate.Target1)
bnd = Bounds(Numbers=flatten(len))
dedomain = DeconstructDomain(Domain=bnd)  # -> Start, End
division = Division(A=dedomain.End, B=B)
int = Integer(division)
mod = Modulus(A=int, B=Slider(2, range=0..10))
subtraction = Subtraction(A=mod, B=1)
neg = Negative(Value=subtraction)
addition = Addition(A=int, B=neg)
divide = DivideCurve(Curve=gate.Target1, Count=addition, Kinks=False)  # -> simplify(Points), Tangents, Parameters
addition_2 = Addition(A=addition, B=1)
panel = Panel("-1")
number_slider = Slider(0, range=0..100)
pline = PolyLine(Vertices=divide.Points, Closed=False)  # -> flatten(Polyline)
explode = Explode(Curve=pline, Recursive=True)  # -> Segments, simplify(Vertices)
filter = StreamFilter(Gate=G, Stream0=gate.Target0, Stream1=pline)
s_0 = ClusterOutput(filter)

# ==== cluster Cluster_7
relay = ClusterInput()
bbox = BoundingBox(Content=relay, Plane=PlaneXY(0, 0, 0), UnionBox=True)  # -> Box, Box_2
debox = DeconstructBox(Box=bbox.Box)  # -> Plane, X, Y, Z
dedomain = DeconstructDomain(Domain=debox.X)  # -> Start, End
dedomain_2 = DeconstructDomain(Domain=debox.Z)  # -> Start, End
subtraction = Subtraction(A=dedomain.End, B=dedomain.Start)
neg = Negative(Value=dedomain_2.Start)
vec = VectorXYZ(XComponent=subtraction, YComponent=0, ZComponent=neg)  # -> Vector, Length
move = Move(Geometry=relay, Motion=vec.Vector)  # -> Geometry, Transform
G = ClusterOutput(move.Geometry)
V = ClusterOutput(vec.Vector)

# ==== cluster Cluster_8
C = ClusterInput()
len = Length(Curve=C)
A = ClusterInput()
B = ClusterInput()
ma = MassAddition(Input=len)  # -> Result, PartialResults
multiplication = Multiplication(A=A, B=B, C=ma.Result)
division = Division(A=multiplication, B=1000)
division_2 = Division(A=division, B=1000)
R = ClusterOutput(division_2)

# ==== cluster OneByOne_2
amp = ClusterInput()
relay = ClusterInput()
intcrv = Interpolate(Vertices=relay, Degree=3, Periodic=False, KnotStyle=1)  # -> Curve, Length, Domain
len = Length(Curve=flatten(intcrv.Curve))
crv_cp = CurveClosestPoint(Point=relay, Curve=intcrv.Curve)  # -> Point, Parameter, Distance
Z = UnitZ(Factor=relay)
bool = Boolean()
reparamnums = ReparameterizeNumbers(Numbers=len, Invert=False)  # -> Reparameterized, Original
eval = EvaluateCurve(Curve=intcrv.Curve, Parameter=crv_cp.Parameter)  # -> Point, Tangent, Angle
vrot = Rotate(Vector=eval.Tangent, Axis=Z, Angle=degrees(Slider(90, range=0..100)))
multiplication = Multiplication(A=amp, B=reparamnums.Reparameterized)
neg = Negative(Value=amp)
unit = UnitVector(Vector=vrot)
tstat = TreeStatistics(Tree=simplify(unit))  # -> Paths, Length, Count
dom = ConstructDomain(DomainStart=neg, DomainEnd=amp)
series = Series(Start=0, Step=1, Count=tstat.Count)
jitter = Jitter(List=series, Jitter=1, Seed=Slider(3, range=0..10))  # -> Values, Indices
random = Random(Range=dom, Number=tstat.Length, Seed=jitter.Values)  # -> simplify(Random)
jitter_2 = Jitter(List=random, Jitter=1, Seed=graft(series))  # -> Values, Indices
amp_2 = Amplitude(Vector=unit, Amplitude=jitter_2.Values)
devec = DeconstructVector(Vector=amp_2)  # -> XComponent, YComponent, ZComponent
vec = VectorXYZ(XComponent=devec.XComponent, YComponent=devec.YComponent, ZComponent=0)  # -> Vector, Length
move = Move(Geometry=relay, Motion=vec.Vector)  # -> Geometry, Transform
pline = PolyLine(Vertices=move.Geometry, Closed=False)
explode = Explode(Curve=pline, Recursive=True)  # -> Segments, simplify(flatten(Vertices))
D = ClusterInput()
subset = SubList(List=explode.Vertices, Domain=D, Wrap=True)  # -> List, Index
V = ClusterOutput()  # disabled
item = ListItem(List=flatten(relay), Index=subset.Index, Wrap=True)
replace = ReplaceItems(List=explode.Vertices, Item=item, Indices=subset.Index, Wrap=False)
L = ClusterOutput(replace)

# ==== cluster QmeshToolpath_Edge
crv = ClusterInput()
relay = ClusterInput()
relay_2 = ClusterInput()
cluster = Cluster(relay=crv)
geo = Geometry(relay_2)
item = ListItem(List=geo, Index=0, Wrap=True)
nullrep = ReplaceNulls(Items=item, Replacements="-1")  # -> Items, Count
larger = LargerThan(FirstNumber=nullrep.Items, SecondNumber="-1")  # -> LargerThan, OrEqualTo
cluster_2 = Cluster_9(relay=cluster, geo=relay_2)
geo_2 = Geometry(cluster_2)
len = Length(Curve=geo_2)
bnd = Bounds(Numbers=len)
dedomain = DeconstructDomain(Domain=bnd)  # -> Start, End
division = Division(A=dedomain.End, B=relay)
int = Integer(division)
divide = DivideCurve(Curve=geo_2, Count=int, Kinks=False)  # -> simplify(Points), Tangents, Parameters
path_mapper = PathMapper(divide.Points, source="{A;B} (i)", target="{A;i} (B)")
flip = FlipMatrix(Data=divide.Points)
filter = StreamFilter(Gate=larger.LargerThan, Stream0=flip, Stream1=path_mapper)
pline = PolyLine(Vertices=divide.Points, Closed=False)  # -> flatten(Polyline)
pline_2 = PolyLine(Vertices=filter, Closed=False)
trim = TrimTree(Tree=pline_2, Depth=1)
cull_i = CullIndex(List=trim, Indices=-1, Wrap=True)  # -> flatten(List)
item_2 = ListItem(List=flatten(trim), Index=-1, Wrap=True)
explode = Explode(Curve=pline, Recursive=True)  # -> flatten(Segments), Vertices
ins = InsertItems(List=cull_i, Item=item_2, Indices=-1, Wrap=True)
len_2 = Length(Curve=explode.Segments)
filter_2 = StreamFilter(Gate=larger.LargerThan, Stream0=flatten(pline_2), Stream1=ins)
bnd_2 = Bounds(Numbers=len_2)
geo_3 = Geometry(filter_2)
I = ClusterOutput(bnd_2)
toolpath = ClusterOutput(filter_2)

# ==== cluster Cluster_10
T = ClusterInput()
relay = ClusterInput()
bbox = BoundingBox(Content=relay, Plane=PlaneXY(0, 0, 0), UnionBox=True)  # -> Box, Box_2
debox = DeconstructBox(Box=bbox.Box)  # -> Plane, X, Y, Z
dedomain = DeconstructDomain(Domain=debox.Z)  # -> Start, End
neg = Negative(Value=dedomain.Start)
Z = UnitZ(Factor=neg)
move = Move(Geometry=relay, Motion=T)  # -> Geometry, Transform
V = ClusterOutput(Z)
G = ClusterOutput(move.Geometry)

# ==== cluster Cluster_11
C = ClusterInput()
len = Length(Curve=C)
ma = MassAddition(Input=flatten(len))  # -> Result, PartialResults
B = ClusterInput()
division = Division(A=ma.Result, B=B)
division_2 = Division(A=division, B=60)
R = ClusterOutput(division_2)

# ==== cluster Cluster_12
bake = ClusterInput()
subdivide = ClusterInput()
file = ClusterInput()
rotate = ClusterInput()
_3dm = Import3DM(File=file, Layer="*", Name="*")
yz = YZPlane(Origin=Point(0, 0, 0))
rotate_2 = Rotate(Geometry=_3dm, Angle=1.570796327, Plane=yz)  # -> Geometry, Transform
filter = StreamFilter(Gate=rotate, Stream0=_3dm, Stream1=rotate_2.Geometry)
python = GhPythonScript(mesh=filter, level=subdivide)  # -> mesh; inputs mesh: Mesh
# ---------- python: Python ----------
__author__ = "okapi"
__version__ = "2022.04.22"

import rhinoscriptsyntax as rs
import Rhino.Geometry as rg
import scriptcontext as sc
import Rhino

meshID = mesh
if level ==0:
    mesh = rs.coercemesh(mesh)
else:
    mesh = rs.coercemesh(mesh)
    subd = rg.SubD.CreateFromMesh(mesh)
    rg.SubD.Subdivide(subd,level)
    
    mesh = rg.Mesh.CreateFromSubD(subd,1)
# ---------- end python ----------
area = Area(Geometry=python)  # -> Area, Centroid
devec = DeconstructVector(Vector=area.Centroid)  # -> XComponent, YComponent, ZComponent
pt = ConstructPoint(XCoordinate=devec.XComponent, YCoordinate=devec.YComponent, ZCoordinate=0)
neg = Negative(Value=pt)
devec_2 = DeconstructVector(Vector=neg)  # -> XComponent, YComponent, ZComponent
vec = VectorXYZ(XComponent=devec_2.XComponent, YComponent=devec_2.YComponent, ZComponent=0)  # -> Vector, Length
move = Move(Geometry=python, Motion=vec.Vector)  # -> Geometry, Transform
bbox = BoundingBox(Content=move.Geometry, Plane=PlaneXY(0, 0, 0))  # -> Box, Box_2
debox = DeconstructBox(Box=bbox.Box)  # -> Plane, X, Y, Z
dedomain = DeconstructDomain(Domain=debox.X)  # -> Start, End
multiplication = Multiplication(A=dedomain.Start, B=Slider(4, range=0..10))
X = UnitX(Factor=multiplication)
multiplication_2 = Multiplication(A=dedomain.Start, B=2)
X_2 = UnitX(Factor=multiplication_2)
move_2 = Move(Geometry=move.Geometry, Motion=X)  # -> Geometry, Transform
neg_2 = Negative(Value=X_2)
move_3 = Move(Geometry=move.Geometry, Motion=X_2)  # -> Geometry, Transform
y = ClusterOutput(neg_2)
bake_2 = ObjectBake(
    BakeToggle=bake,
    GeometryObjects=move_3.Geometry,
    Layer="GH_Bake",
    ObjectName="GH_Obj",
    ObjectColor=RGB(0, 0, 0),
    LayerColor=RGB(0, 0, 0))

# ==== cluster Cluster
relay = ClusterInput()
item = ListItem(List=relay, Index=0, Wrap=True)
flip = FlipCurve(Curve=relay, Guide=item)  # -> Curve, Flag
C = ClusterOutput(flip.Curve)

# ==== cluster Cluster_9
relay = ClusterInput()
geo = ClusterInput()
geo_2 = Geometry(graft(geo))
item = ListItem(List=geo_2, Index=0, Wrap=True)
pcen = PolygonCenter(Polyline=item)  # -> CenterV, CenterE, CenterA
pcen_2 = PolygonCenter(Polyline=relay)  # -> CenterV, CenterE, CenterA
pt = Point(pcen_2.CenterV)
pt_2 = Point(flatten(pcen.CenterV))
cp = ClosestPoint(Point=pt_2, Cloud=pt)  # -> ClosestPoint, CPIndex, Distance
sort = SortList(Keys=cp.CPIndex)  # -> Keys, ValuesA
number_slider = Slider(1, range=0..1)
lng = ListLength(List=sort.Keys)
larger = LargerThan(FirstNumber=lng, SecondNumber=Slider(0, range=0..100))  # -> LargerThan, OrEqualTo
null = NullItem(Item=cp.CPIndex)  # -> NullFlags, InvalidFlags, Description
item_2 = ListItem(List=relay, Index=sort.Keys, Wrap=True)
python = GhPythonScript(list=relay, index=sort.Keys)  # -> out, a; inputs list: list, index: list
# ---------- python: Python ----------
__author__ = "okapi"
__version__ = "2022.07.04"

import rhinoscriptsyntax as rs

a = []
listLength = len(index)
if index[0] == 0:
    a.append(len(list)+1)
else:
    for i in range(len(index)):
        if i==0:
            a.append(index[i]+1)
        else:
            a.append(index[i]-index[i-1]+1)
    
    a.append(len(list)-index[-1])
# ---------- end python ----------
number_slider_2 = Slider(14, range=0..100)
number_slider_3 = Slider(0, range=0..100)
invbool = InvertBoolean(Boolean=null.NullFlags)  # -> Inverted, Number
ins = InsertItems(List=relay, Item=item_2, Indices=sort.Keys, Wrap=True)
partition = PartitionList(List=ins, Size=python.a)  # -> simplify(Chunks)
explode = Explode(Curve=partition, Recursive=True)  # -> Segments, simplify(Vertices)
gate = StreamGate(Stream=explode.Vertices, Gate=invbool.Inverted)  # -> Target0, Target1
path_mapper = PathMapper(gate.Target1, source="{A;B} (i)", target="{A;i} (B)")
flip = FlipMatrix(Data=gate.Target0)
pline = PolyLine(Vertices=flip, Closed=False)  # -> flatten(Polyline)
pline_2 = PolyLine(Vertices=path_mapper, Closed=False)
trim = TrimTree(Tree=pline_2, Depth=1)
filter = StreamFilter(Gate=invbool.Inverted, Stream0=pline, Stream1=trim)
end = EndPoints(Curve=pline)  # -> Start, End
s_0 = ClusterOutput(filter)
